# Grasshopper definition 00-check_json.gh (Grasshopper 0.9.76)
# plug-ins: Python Interpreter

number_slider = Slider(5, range=1..877)
panel = Panel("E:\Local Code\Work\Local Code - Los Angeles\02 geoJSON\15_06_03\")
import_geojson = ImportGeoJSON(Import=Toggle(True), geoJSONFolderPath=panel, SiteNumber=number_slider)  # -> out, Geometry, Attributes, Values, LayerNames; inputs Import: Boolean, SiteNumber: Int32
# ---------- import_geojson: Python ----------
"""
Allows for the translation of GeoJSON data to Rhino objects

GeoJSON _does_ support 3d, so this can take 3d coordinates for 3d GeoJSONs

The GeoJSON Format Specification can be found here:
    http://geojson.org/geojson-spec.html

The RhinoCommon SDK (where all the Rhino.Geometry objects are documented) is
here:
    http://www.rhino3d.com/5/rhinocommon/

I have decided to extend the GeoJSON specification by adding support for one
more type of geometry that would be really useful in Rhino (and elsewhere),
the Mesh. Here is an example of a json Mesh:

    {"type": "Feature",
     "geometry": {
                  "type": "Mesh",
                  "coordinates": [
                                  [3.43, 54.234, 2343.23],
                                  [...],
                                  [...],
                                  ...,
                                  ]
                  "faces": [
                            [0,3,2],
                            [5,32,1],
                            ...,
                            ]
                  }
      "properties": {"prop0": "value0"}
      }


Example of Use:
    >>> import GeoJson2Rhino as geoj
    >>> myGeoJson = '''
{ "type": "FeatureCollection",
  "features": [
    { "type": "Feature",
      "geometry": {"type": "Point", "coordinates": [102.0, 0.5]},
      "properties": {"prop0": "value0"}
      },
    { "type": "Feature",
      "geometry": {
        "type": "LineString",
        "coordinates": [
          [102.0, 0.0], [103.0, 1.0], [104.0, 0.0], [105.0, 1.0]
          ]
        },
      "properties": {
        "prop0": "value0",
        "prop1": 0.0
        }
      },
    { "type": "Feature",
       "geometry": {
         "type": "Polygon",
         "coordinates": [
           [ [100.0, 0.0], [101.0, 0.0], [101.0, 1.0],
             [100.0, 1.0], [100.0, 0.0] ]
           ]
       },
       "properties": {
         "prop0": "value0",
         "prop1": {"this": "that"}
         }
       }
     ]
   }'''
   >>> guidList = geoj.load(myGeoJson) #stores guids of new rhino objects

"""
import os
import sys
import System.Text
bodyname = System.Text.Encoding.Default.BodyName
sys.setdefaultencoding(bodyname)


# Import standard library modules
import json
# Import Rhino modules
import Rhino
from Rhino.Geometry import *
from scriptcontext import doc

# import .NET libraries
import System
from System import Object
import rhinoscriptsyntax as rs
import sys
import os
import rhinoscriptsyntax as rs

# import GH dependencies
from clr import AddReference as addr
addr("Grasshopper")
from Grasshopper import DataTree
from Grasshopper.Kernel.Data import GH_Path

def addRhinoLayer(layerName, layerColor=System.Drawing.Color.Black):
    """Creates a Layer in Rhino using a name and optional color. Returns the
    index of the layer requested. If the layer
    already exists, the color is updated and no new layer is created."""
    docLyrs = doc.Layers
    layerIndex = docLyrs.Find(layerName, True)
    if layerIndex == -1:
        layerIndex = docLyrs.Add(layerName,layerColor)
    else: # it exists
        layer = docLyrs[layerIndex] # so get it
        if layer.Color != layerColor: # if it has a different color
            layer.Color = layerColor # reset the color
    return layerIndex

def PointToRhinoPoint(coordinates):
    if len(coordinates) > 2:
        z = coordinates[2]
    else:
        z = 0.0
    x, y = coordinates[0], coordinates[1]
    return Point3d(x, y, z)

def MultiPointToRhinoPoint(coordinates):
    rhPointList = []
    for point in coordinates:
        rhPointList.append(PointToRhinoPoint(point))
    return rhPointList

def MeshToRhinoMesh(coordinates, faces):
    rhMesh = Mesh()
    for point in coordinates:
        rhPoint = PointToRhinoPoint(point)
        rhMesh.Vertices.Add(rhPoint)
    for face in faces:
        i, j, k = tuple(face)
        mFace = MeshFace(i, j, k)
        rhMesh.Faces.AddFace(mFace)
    rhMesh.Normals.ComputeNormals()
    rhMesh.Compact()
    return rhMesh

def LineStringToRhinoCurve(coordinates):
    rhPoints = MultiPointToRhinoPoint(coordinates)
    return Curve.CreateControlPointCurve(rhPoints, 1)

def MultiLineStringToRhinoCurve(coordinates):
    rhCurveList = []
    for lineString in coordinates:
        rhCurveList.append(LineStringToRhinoCurve(lineString))
    return rhCurveList

def PolygonToRhinoCurve(coordinates):
    # each ring is a separate list of coordinates
    ringList = []
    for ring in coordinates:
        ringList.append(LineStringToRhinoCurve(ring))
    return ringList

def MultiPolygonToRhinoCurve(coordinates):
    polygonList = []
    for polygon in coordinates:
        polygonList.append(PolygonToRhinoCurve(polygon))
    return polygonList

def GeometryCollectionToParser(geometries):
    pass # I need to figure this one out still

def addPoint(rhPoint, objAtt):
    return doc.Objects.AddPoint(rhPoint, objAtt)

def addPoints(rhPoints, objAtt):
    guidList = []
    for rhPoint in rhPoints:
        guidList.append(doc.Objects.AddPoint(rhPoint, objAtt))
    return guidList

def addCurve(rhCurve, objAtt):
    return doc.Objects.AddCurve(rhCurve, objAtt)

def addCurves(rhCurves, objAtt):
    guidList = []
    for curve in rhCurves:
        guidList.append(addCurve(curve, objAtt))
    return guidList

def addPolygon(ringList, objAtt):
    # for now this just makes curves
    # but maybe it should make TrimmedSrfs
    # or should group the rings
    return addCurves(ringList, objAtt)

def addPolygons(polygonList, objAtt):
    guidList = []
    for polygon in polygonList:
        # !! Extending the guid list !!!
        guidList.extend(addPolygon(polygon, objAtt))
    return guidList

def addMesh(rhMesh, objAtt):
    return doc.Objects.AddMesh(rhMesh, objAtt)

geoJsonGeometryMap = {
        'Point':(PointToRhinoPoint, addPoint),
        'MultiPoint':(MultiPointToRhinoPoint, addPoints),
        'LineString':(LineStringToRhinoCurve, addCurve),
        'MultiLineString':(MultiLineStringToRhinoCurve, addCurves),
        'Polygon':(PolygonToRhinoCurve, addPolygon),
        'MultiPolygon':(MultiPolygonToRhinoCurve, addPolygons),
        'Mesh':(MeshToRhinoMesh, addMesh),
        'GeometryCollection':(GeometryCollectionToParser),
        }

def setUserKeys(properties, objAttributes):
    for key in properties:
        objAttributes.SetUserString(key, str(properties[key]))
    return objAttributes

def jsonToRhinoCommon(jsonFeature):
        # deal with the geometry
        geom = jsonFeature['geometry']
        geomType = geom['type'] # this will return a mappable string
        coordinates = geom['coordinates']
        # if this is a mesh, pass the faces
        if geomType == 'Mesh':
            faces = geom['faces']
            rhFeature = geoJsonGeometryMap[geomType][0](coordinates, faces)
        # translate the coordinates to Rhino.Geometry objects
        else:
            rhFeature = geoJsonGeometryMap[geomType][0](coordinates)
        return rhFeature

def addJsonFeature(jsonFeature, objAttributes):
        # deal with the properties
        if jsonFeature['properties']:
            objAttributes = setUserKeys(jsonFeature['properties'], objAttributes)
        geomType = jsonFeature['geometry']['type']
        rhFeature = jsonToRhinoCommon(jsonFeature)
        # return the GUID(s) for the feature
        return geoJsonGeometryMap[geomType][1](rhFeature, objAttributes)

def processGeoJson(parsedGeoJson,
         destinationLayer=None,
         destinationLayerColor=System.Drawing.Color.Black):
    # get the features
    jsonFeatures = parsedGeoJson['features']
    guidResults = []
    # set up object attributes
    for jsonFeature in jsonFeatures: # for each feature
        att = Rhino.DocObjects.ObjectAttributes()
        # setup layer if requested
        if destinationLayer != None:
            destinationLayer = None
            #att.LayerIndex = addRhinoLayer(destinationLayer,
                                           #destinationLayerColor)
        guidResults.append(addJsonFeature(jsonFeature, att))
    # return all the guids
    return guidResults
def load(rawJsonData,
         prefix=None,
         destinationLayer=None,
         destinationLayerColor=System.Drawing.Color.Black):
    # if the data already appears to be a dict literal ...
    if type(rawJsonData) == dict:
        jsonData = rawJsonData
    else: # otherwise, just try to load it
        jsonData = json.loads(rawJsonData)
    # if this is just a GeoJSON ...
    if jsonData["type"] == "FeatureCollection":
        # process the GeoJSON, pass the layer and color in
        return processGeoJson(jsonData, destinationLayer,
                              destinationLayerColor)
    # or if this is a set of layers from PostSites ...
    elif jsonData["type"] == "LayerCollection":
        # make a list for all the guids
        allResults = []
        layersList = jsonData['layers']
        for layer in layersList: # for each layer
            name = prefix + layer['name'] # get the name, modified to add filename to 
            if 'color' in layer: # get the color if it exists
                color = layer['color']
            else:
                color = destinationLayerColor # or just make it black
            geoJson = layer['contents'] # get the GeoJSON for this layer
            # make it
            layerResults = processGeoJson( geoJson, name, color )
            allResults.append(layerResults)
        return allResults, layersList
    else:
        return "This doesn't look like correctly formatted GeoJSON data.\nI'm not sure what to do with it, sorry."

idsOut = []
layerNamesOut = []
def getAttsVals(id,path=None):
    objct = doc.Objects.Find(id)
    data = objct.Attributes.GetUserStrings()
    d = {}
    k = []
    v = []
    if path==None:
        for u in sorted(data):
            k.append(u)
            print k
            d[u] = data[u]
            v.append(d[u])
        U = d
        Atts = k
        Vals = v
        return Atts,Vals
    if path:
        for u in data:
            k.append(u)
            d[u] = data[u]
            v.append(d[u])
            Attributes.Add(u,path)
            Values.Add(d[u],path)
        return None,None
    
def importSitefolder (filepath):
    f = str(SiteNumber)
    prefix = str(f +"_")
    try:
        f = open (filepath+"/"+f,'r')
    except:
        f = open (filepath+"/"+f+'.txt','r')
    myGeoJson = f.readline()
    guidList,layersList = load(myGeoJson, prefix)
    idsOut.append(guidList)
    layerNamesOut.append(layersList)
    f.close()

if Import!= None and type(Import) == bool:
    if Import == True:
        try:
            importSitefolder(geoJSONFolderPath)
            if guidList != None:
                message = 'You succesfully imported a geoJSON file!' 
            else:
                message = 'There was some problem with your geoJSON file, we imported as many layers as possible!'
                
        except:
            pass
else:
    print 'To Import you need to input a boolean toggle'

Geometry = DataTree[Object]()
Attributes = DataTree[Object]()
Values = DataTree[Object]()
LayerNames = DataTree[Object]()

### NOTE: some problems with mutlipolygons being nested 'up' a level. This problem is rooted in 'loader'
### it needs to be debugged out
print layerNamesOut
for i in range (len(layerNamesOut[0])):
    p = GH_Path(i)
    LayerNames.Add(layerNamesOut[0][i]['name'],p)
    
for A in idsOut:#for each file
    for i in range (len(A)):# for each layer
        try:
            p = GH_Path(i)#make a new data tree path
            if (len(A[i])>1):# if the datatree path has more than one item
                for j in range (len(A[i])):# iterate
                    try:
                        thisId = A[i][j][0]
                        pPrime = p.AppendElement(j)
                        Geometry.Add(thisId,p)# add each feature to the path
                        getAttsVals(thisId,pPrime)
                    except:
                        ### It must be a point (tuple), cannot subscript it, grab it directly
                        try:
                            thisId = A[i][j]
                            pPrime = p.AppendElement(j)
                            Geometry.Add(thisId,p)
                            getAttsVals(thisId,pPrime)
                        except:
                            continue
            else:#otherwise, the layer has only one item (it is either a 1 item layer or a multipolygon)
                #it is a single object layer
                try:
                    thisId = A[i][0]
                    pPrime = p.AppendElement(0)
                    Geometry.Add(thisId,p)
                    getAttsVals(thisId,pPrime)
                except: #multipolygon is nested one level
                    print "Multipolygon found, some list-cleanup may be needed"
                    thisId = A[i][0][0]
                    pPrime = p.AppendElement(0)
                    Geometry.Add(thisId,p)
                    getAttsVals(thisId,pPrime)
        except:
            print 'There were some problems importing a layer, please try again with a different set of layers'
            continue
# ---------- end import_geojson ----------
number_slider_2 = Slider(0, range=0..100)
unpickle_geometry = UnPickleGeometry(
    siteNumber=number_slider,
    layer="siteoutline",
    path="E:\Local Code\Work\Local Code - Los Angeles\06 DB\",
    read=Toggle(True))  # -> out, geometry
# ---------- unpickle_geometry: Python ----------
import cPickle as pickle

if path and read and layer:
    try:
        if siteNumber:
            f = open(path+str(int(siteNumber))+layer)
        else:
            f = open(path+layer)
        geometry = pickle.load(f)
        f.close()

    except:
        print 'problem loading %s\nfile may not exist' % path+str(int(siteNumber))+layer
# ---------- end unpickle_geometry ----------
boundary = BoundarySurfaces(Edges=unpickle_geometry.geometry)
panel_2 = Panel(import_geojson.LayerNames)
mindex = MemberIndex(Set=flatten(import_geojson.LayerNames), Member="proposed_sites_buffer100a")  # -> Index, Count
mindex_2 = MemberIndex(Set=flatten(import_geojson.LayerNames), Member="site")  # -> Index, Count
mindex_3 = MemberIndex(Set=flatten(import_geojson.LayerNames), Member="random_pts150")  # -> Index, Count
select_a_layer_from_geojson = SelectALayerFromGeoJSON(
    layer_number=mindex.Index,
    geometry_lists=import_geojson.Geometry,
    gis_attributes=import_geojson.Attributes,
    gis_values=import_geojson.Values,
    layer_list=import_geojson.LayerNames)  # -> geometry, gis_attributes_2, gis_values_2, layer_name
select_a_layer_from_geojson_2 = SelectALayerFromGeoJSON(
    layer_number=mindex_2.Index,
    geometry_lists=import_geojson.Geometry,
    gis_attributes=import_geojson.Attributes,
    gis_values=import_geojson.Values,
    layer_list=import_geojson.LayerNames)  # -> geometry, gis_attributes_2, gis_values_2, layer_name
select_a_layer_from_geojson_3 = SelectALayerFromGeoJSON(
    layer_number=mindex_3.Index,
    geometry_lists=import_geojson.Geometry,
    gis_attributes=import_geojson.Attributes,
    gis_values=import_geojson.Values,
    layer_list=import_geojson.LayerNames)  # -> geometry, gis_attributes_2, gis_values_2, layer_name
item = ListItem(List=select_a_layer_from_geojson_3.gis_values_2, Index=Slider(5, range=0..10), Wrap=True)
panel_3 = Panel(item)
Z = UnitZ(Factor=item)
move = Move(Geometry=select_a_layer_from_geojson_3.geometry, Motion=Z)  # -> Geometry, Transform
del = DelaunayMesh(Points=flatten(move.Geometry), Plane=PlaneXY(0, 0, 0))
medges = MeshEdges(Mesh=del)  # -> NakedEdges, InteriorEdges, NonManifoldEdges

# ==== cluster SelectALayerFromGeoJSON: Select a specific layer from a group of layers imported from a geoJSON
layer_number = ClusterInput()  # Select a layer from the geoJSON. Input an integer
geometry_lists = ClusterInput()  # Input geometry lists from geJSON
gis_attributes = ClusterInput()  # Input list of GIS attributes from geoJSON.
layer_list = ClusterInput()  # List of Layers.
gis_values = ClusterInput()  # Input list of GIS values from geoJSON
int = Integer(layer_number)
item = ListItem(List=flatten(layer_list), Index=expr("x-1", int), Wrap=False)
rep = ReplaceString(String="{X;*}", Find="X", Replace=int, RecursiveReplace=False)
tsplit = SplitTree(Data=gis_attributes, Masks=rep)  # -> Positive, Negative
tsplit_2 = SplitTree(Data=gis_values, Masks=rep)  # -> Positive, Negative
tsplit_3 = SplitTree(Data=geometry_lists, Masks=rep)  # -> graft(Positive), Negative
gis_attributes_2 = ClusterOutput(tsplit.Positive)  # Selected layer's GIS attributes.
gis_values_2 = ClusterOutput(tsplit_2.Positive)  # List of selected layer's GIS Values.
geometry = ClusterOutput(tsplit_3.Positive)  # List of geometry for selected layer.
layer_name = ClusterOutput(item)  # Name of Selected Layer.
