# Grasshopper definition 00-checker.gh (Grasshopper 0.9.76)
# plug-ins: Python Interpreter

number_slider = Slider(15, range=1..1375)
panel = Panel("F:\Local Code\Work\Local Code - Los Angeles\06 DB\")
panel_2 = Panel("""billboards
fullterrainmesh
parcels
siteoutline
view""")
unpickle_geometry = UnPickleGeometry(siteNumber=number_slider, layer="Data_CNN", path=panel, read=panel)  # -> out, geometry
# ---------- unpickle_geometry: Python ----------
import cPickle as pickle

if path and read and layer:
    try:
        if siteNumber:
            f = open(path+str(int(siteNumber))+layer)
        else:
            f = open(path+layer)
        geometry = pickle.load(f)
        f.close()

    except:
        print 'problem loading %s\nfile may not exist' % path+str(int(siteNumber))+layer
# ---------- end unpickle_geometry ----------
unpickle_geometry_2 = UnPickleGeometry(siteNumber=number_slider, layer=panel_2, path=panel, read=Toggle(True))  # -> out, simplify(geometry); same code as unpickle_geometry
