# Grasshopper definition 02-PicklestoCurbstoFlowlinesandCamera-H.gh (Grasshopper 0.9.76)
# plug-ins: MeshEdit Components, LocalCode, Python Interpreter

pickles = Panel("C:\Users\Carlos Emilio\Desktop\Local Code - Los Angeles\06 DB\")
panel = Panel("""fullterrainmesh
siteoutline""")
number_slider = Slider(20, range=1..20)
panel_2 = Panel("F:\Local Code\Work\Local Code - Los Angeles\06 DB\")
mindex = MemberIndex(Set=panel, Member="fullterrainmesh")  # -> Index, Count
mindex_2 = MemberIndex(Set=panel, Member="siteoutline")  # -> Index, Count
int = Integer(number_slider)
mindex_3 = MemberIndex(Set=panel, Member="siteoutline")  # -> Index, Count
unpickle_geometry = UnPickleGeometry(siteNumber=number_slider, layer="Data_CNN", path=panel_2, read=panel_2)  # -> out, geometry
# ---------- unpickle_geometry: Python ----------
import cPickle as pickle

if path and read and layer:
    try:
        if siteNumber:
            f = open(path+str(int(siteNumber))+layer)
        else:
            f = open(path+layer)
        geometry = pickle.load(f)
        f.close()

    except:
        print 'problem loading %s\nfile may not exist' % path+str(int(siteNumber))+layer
# ---------- end unpickle_geometry ----------
mindex_4 = MemberIndex(Set=panel, Member="siteoutline")  # -> Index, Count
path = ConstructPath(Indices=mindex.Index)
path_2 = ConstructPath(Indices=mindex_2.Index)
path_3 = ConstructPath(Indices=mindex_3.Index)
unpickle_geometry_2 = UnPickleGeometry(siteNumber=number_slider, layer=panel, path=panel_2, read=Toggle(True))  # -> out, simplify(geometry); same code as unpickle_geometry
# NEED TO ADD SCALE FACTOR TO FLOWLINES
geo = Geometry(unpickle_geometry_2.geometry)

# ---- group: referenced geometry
geo_2 = Geometry(unpickle_geometry_2.geometry)

# ---- group: ImportedGeometry
geo_3 = Geometry(unpickle_geometry_2.geometry)

# ----
panel_3 = Panel(geo_2)
branch = TreeBranch(Tree=geo, Path=path_2, MaintainPaths=True)
branch_2 = TreeBranch(Tree=geo, Path=path, MaintainPaths=True)
branch_3 = TreeBranch(Tree=geo_3, Path=path_3, MaintainPaths=True)
bbox = BoundingBox(Content=branch, Plane=PlaneXY(0, 0, 0))  # -> Box, Box_2
geo_4 = Geometry(branch_3)
debrep = DeconstructBrep(Brep=bbox.Box)  # -> Faces, Edges, Vertices
area = Area(Geometry=debrep.Faces)  # -> Area, Centroid
pdecon = Deconstruct(Point=area.Centroid)  # -> XComponent, YComponent, ZComponent
project = Project(Geometry=geo_4, Plane=PlaneXY(0, 0, 0))  # -> Geometry, Transform
sort = SortList(Keys=pdecon.ZComponent, ValuesA=debrep.Faces)  # -> Keys, ValuesA
panel_4 = Panel(unpickle_geometry_2.geometry)
item = ListItem(List=sort.ValuesA, Index=0, Wrap=True)
debrep_2 = DeconstructBrep(Brep=item)  # -> Faces, Edges, Vertices
viewer = ParamViewer(unpickle_geometry_2.geometry)
boundary = BoundarySurfaces(Edges=project.Geometry)
join = JoinCurves(Curves=debrep_2.Edges, Preserve=False)
explode = MeshExplode(Mesh=branch_2, Interpolate=False)
area_2 = Area(Geometry=join)  # -> Area, Centroid
number_slider_2 = Slider(7, range=0..10)
area_3 = MeshArea(Mesh=explode)  # -> Area, Centroid
scale = Scale(Geometry=join, Center=area_2.Centroid, Factor=Slider(2, range=0..10))  # -> Geometry, Transform
project_2 = Project(Geometry=scale.Geometry, Plane=PlaneXY(0, 0, 0))  # -> Geometry, Transform
project_3 = Project(Geometry=area_3.Centroid, Plane=PlaneXY(0, 0, 0))  # -> Geometry, Transform
incurve = PointInCurve(Point=project_3.Geometry, Curve=project_2.Geometry)  # -> Relationship, Point
number_slider_3 = Slider(100, range=0..100)
cull = CullPattern(List=explode, CullPattern=incurve.Relationship)
lineyness = Slider(2.4, range=0..10)
number_slider_4 = Slider(100, range=0..100)  # disabled
mjoin = MeshJoin(Meshes=cull)
geo_5 = Geometry(branch_2)
bbox_2 = BoundingBox(Content=geo_5, Plane=PlaneXY(0, 0, 0))  # -> Box, Box_2
debrep_3 = DeconstructBrep(Brep=bbox_2.Box)  # -> Faces, Edges, Vertices
panel_5 = Panel("F:\Local Code\Work\Local Code - Los Angeles\05 Rhino\dump\")  # disabled
panel_6 = Panel("C:\Users\Carlos Emilio\Desktop\siteJSONS\")  # disabled
area_4 = Area(Geometry=debrep_3.Faces)  # -> Area, Centroid
toggle = BooleanToggle(False)  # disabled
number_slider_5 = Slider(1, range=0..10)  # disabled
pdecon_2 = Deconstruct(Point=area_4.Centroid)  # -> XComponent, YComponent, ZComponent
concat = Concatenate(FragmentA=panel_5)  # disabled
panel_7 = Panel("-terrain.3dm")  # disabled
import_geojson = ImportGeoJSON(Import=toggle, geoJSONFolderPath=panel_6, SiteNumber=int)  # -> out, Geometry, Attributes, Values, LayerNames; inputs Import: Boolean, SiteNumber: Int32; disabled
# ---------- import_geojson: Python ----------
"""
Allows for the translation of GeoJSON data to Rhino objects

GeoJSON _does_ support 3d, so this can take 3d coordinates for 3d GeoJSONs

The GeoJSON Format Specification can be found here:
    http://geojson.org/geojson-spec.html

The RhinoCommon SDK (where all the Rhino.Geometry objects are documented) is
here:
    http://www.rhino3d.com/5/rhinocommon/

I have decided to extend the GeoJSON specification by adding support for one
more type of geometry that would be really useful in Rhino (and elsewhere),
the Mesh. Here is an example of a json Mesh:

    {"type": "Feature",
     "geometry": {
                  "type": "Mesh",
                  "coordinates": [
                                  [3.43, 54.234, 2343.23],
                                  [...],
                                  [...],
                                  ...,
                                  ]
                  "faces": [
                            [0,3,2],
                            [5,32,1],
                            ...,
                            ]
                  }
      "properties": {"prop0": "value0"}
      }


Example of Use:
    >>> import GeoJson2Rhino as geoj
    >>> myGeoJson = '''
{ "type": "FeatureCollection",
  "features": [
    { "type": "Feature",
      "geometry": {"type": "Point", "coordinates": [102.0, 0.5]},
      "properties": {"prop0": "value0"}
      },
    { "type": "Feature",
      "geometry": {
        "type": "LineString",
        "coordinates": [
          [102.0, 0.0], [103.0, 1.0], [104.0, 0.0], [105.0, 1.0]
          ]
        },
      "properties": {
        "prop0": "value0",
        "prop1": 0.0
        }
      },
    { "type": "Feature",
       "geometry": {
         "type": "Polygon",
         "coordinates": [
           [ [100.0, 0.0], [101.0, 0.0], [101.0, 1.0],
             [100.0, 1.0], [100.0, 0.0] ]
           ]
       },
       "properties": {
         "prop0": "value0",
         "prop1": {"this": "that"}
         }
       }
     ]
   }'''
   >>> guidList = geoj.load(myGeoJson) #stores guids of new rhino objects

"""
import os
import sys
import System.Text
bodyname = System.Text.Encoding.Default.BodyName
sys.setdefaultencoding(bodyname)


# Import standard library modules
import json
# Import Rhino modules
import Rhino
from Rhino.Geometry import *
from scriptcontext import doc

# import .NET libraries
import System
from System import Object
import rhinoscriptsyntax as rs
import sys
import os
import rhinoscriptsyntax as rs

# import GH dependencies
from clr import AddReference as addr
addr("Grasshopper")
from Grasshopper import DataTree
from Grasshopper.Kernel.Data import GH_Path

def addRhinoLayer(layerName, layerColor=System.Drawing.Color.Black):
    """Creates a Layer in Rhino using a name and optional color. Returns the
    index of the layer requested. If the layer
    already exists, the color is updated and no new layer is created."""
    docLyrs = doc.Layers
    layerIndex = docLyrs.Find(layerName, True)
    if layerIndex == -1:
        layerIndex = docLyrs.Add(layerName,layerColor)
    else: # it exists
        layer = docLyrs[layerIndex] # so get it
        if layer.Color != layerColor: # if it has a different color
            layer.Color = layerColor # reset the color
    return layerIndex

def PointToRhinoPoint(coordinates):
    if len(coordinates) > 2:
        z = coordinates[2]
    else:
        z = 0.0
    x, y = coordinates[0], coordinates[1]
    return Point3d(x, y, z)

def MultiPointToRhinoPoint(coordinates):
    rhPointList = []
    for point in coordinates:
        rhPointList.append(PointToRhinoPoint(point))
    return rhPointList

def MeshToRhinoMesh(coordinates, faces):
    rhMesh = Mesh()
    for point in coordinates:
        rhPoint = PointToRhinoPoint(point)
        rhMesh.Vertices.Add(rhPoint)
    for face in faces:
        i, j, k = tuple(face)
        mFace = MeshFace(i, j, k)
        rhMesh.Faces.AddFace(mFace)
    rhMesh.Normals.ComputeNormals()
    rhMesh.Compact()
    return rhMesh

def LineStringToRhinoCurve(coordinates):
    rhPoints = MultiPointToRhinoPoint(coordinates)
    return Curve.CreateControlPointCurve(rhPoints, 1)

def MultiLineStringToRhinoCurve(coordinates):
    rhCurveList = []
    for lineString in coordinates:
        rhCurveList.append(LineStringToRhinoCurve(lineString))
    return rhCurveList

def PolygonToRhinoCurve(coordinates):
    # each ring is a separate list of coordinates
    ringList = []
    for ring in coordinates:
        ringList.append(LineStringToRhinoCurve(ring))
    return ringList

def MultiPolygonToRhinoCurve(coordinates):
    polygonList = []
    for polygon in coordinates:
        polygonList.append(PolygonToRhinoCurve(polygon))
    return polygonList

def GeometryCollectionToParser(geometries):
    pass # I need to figure this one out still

def addPoint(rhPoint, objAtt):
    return doc.Objects.AddPoint(rhPoint, objAtt)

def addPoints(rhPoints, objAtt):
    guidList = []
    for rhPoint in rhPoints:
        guidList.append(doc.Objects.AddPoint(rhPoint, objAtt))
    return guidList

def addCurve(rhCurve, objAtt):
    return doc.Objects.AddCurve(rhCurve, objAtt)

def addCurves(rhCurves, objAtt):
    guidList = []
    for curve in rhCurves:
        guidList.append(addCurve(curve, objAtt))
    return guidList

def addPolygon(ringList, objAtt):
    # for now this just makes curves
    # but maybe it should make TrimmedSrfs
    # or should group the rings
    return addCurves(ringList, objAtt)

def addPolygons(polygonList, objAtt):
    guidList = []
    for polygon in polygonList:
        # !! Extending the guid list !!!
        guidList.extend(addPolygon(polygon, objAtt))
    return guidList

def addMesh(rhMesh, objAtt):
    return doc.Objects.AddMesh(rhMesh, objAtt)

geoJsonGeometryMap = {
        'Point':(PointToRhinoPoint, addPoint),
        'MultiPoint':(MultiPointToRhinoPoint, addPoints),
        'LineString':(LineStringToRhinoCurve, addCurve),
        'MultiLineString':(MultiLineStringToRhinoCurve, addCurves),
        'Polygon':(PolygonToRhinoCurve, addPolygon),
        'MultiPolygon':(MultiPolygonToRhinoCurve, addPolygons),
        'Mesh':(MeshToRhinoMesh, addMesh),
        'GeometryCollection':(GeometryCollectionToParser),
        }

def setUserKeys(properties, objAttributes):
    for key in properties:
        objAttributes.SetUserString(key, str(properties[key]))
    return objAttributes

def jsonToRhinoCommon(jsonFeature):
        # deal with the geometry
        geom = jsonFeature['geometry']
        geomType = geom['type'] # this will return a mappable string
        coordinates = geom['coordinates']
        # if this is a mesh, pass the faces
        if geomType == 'Mesh':
            faces = geom['faces']
            rhFeature = geoJsonGeometryMap[geomType][0](coordinates, faces)
        # translate the coordinates to Rhino.Geometry objects
        else:
            rhFeature = geoJsonGeometryMap[geomType][0](coordinates)
        return rhFeature

def addJsonFeature(jsonFeature, objAttributes):
        # deal with the properties
        if jsonFeature['properties']:
            objAttributes = setUserKeys(jsonFeature['properties'], objAttributes)
        geomType = jsonFeature['geometry']['type']
        rhFeature = jsonToRhinoCommon(jsonFeature)
        # return the GUID(s) for the feature
        return geoJsonGeometryMap[geomType][1](rhFeature, objAttributes)

def processGeoJson(parsedGeoJson,
         destinationLayer=None,
         destinationLayerColor=System.Drawing.Color.Black):
    # get the features
    jsonFeatures = parsedGeoJson['features']
    guidResults = []
    # set up object attributes
    for jsonFeature in jsonFeatures: # for each feature
        att = Rhino.DocObjects.ObjectAttributes()
        # setup layer if requested
        if destinationLayer != None:
            destinationLayer = None
            #att.LayerIndex = addRhinoLayer(destinationLayer,
                                           #destinationLayerColor)
        guidResults.append(addJsonFeature(jsonFeature, att))
    # return all the guids
    return guidResults
def load(rawJsonData,
         prefix=None,
         destinationLayer=None,
         destinationLayerColor=System.Drawing.Color.Black):
    # if the data already appears to be a dict literal ...
    if type(rawJsonData) == dict:
        jsonData = rawJsonData
    else: # otherwise, just try to load it
        jsonData = json.loads(rawJsonData)
    # if this is just a GeoJSON ...
    if jsonData["type"] == "FeatureCollection":
        # process the GeoJSON, pass the layer and color in
        return processGeoJson(jsonData, destinationLayer,
                              destinationLayerColor)
    # or if this is a set of layers from PostSites ...
    elif jsonData["type"] == "LayerCollection":
        # make a list for all the guids
        allResults = []
        layersList = jsonData['layers']
        for layer in layersList: # for each layer
            name = prefix + layer['name'] # get the name, modified to add filename to 
            if 'color' in layer: # get the color if it exists
                color = layer['color']
            else:
                color = destinationLayerColor # or just make it black
            geoJson = layer['contents'] # get the GeoJSON for this layer
            # make it
            layerResults = processGeoJson( geoJson, name, color )
            allResults.append(layerResults)
        return allResults, layersList
    else:
        return "This doesn't look like correctly formatted GeoJSON data.\nI'm not sure what to do with it, sorry."

idsOut = []
layerNamesOut = []
def getAttsVals(id,path=None):
    objct = doc.Objects.Find(id)
    data = objct.Attributes.GetUserStrings()
    d = {}
    k = []
    v = []
    if path==None:
        for u in sorted(data):
            k.append(u)
            print k
            d[u] = data[u]
            v.append(d[u])
        U = d
        Atts = k
        Vals = v
        return Atts,Vals
    if path:
        for u in data:
            k.append(u)
            d[u] = data[u]
            v.append(d[u])
            Attributes.Add(u,path)
            Values.Add(d[u],path)
        return None,None
    
def importSitefolder (filepath):
    f = str(SiteNumber)
    prefix = str(f +"_")
    try:
        f = open (filepath+"/"+f,'r')
    except:
        f = open (filepath+"/"+f+'.json','r')
    myGeoJson = f.readline()
    guidList,layersList = load(myGeoJson, prefix)
    idsOut.append(guidList)
    layerNamesOut.append(layersList)
    f.close()

if Import!= None and type(Import) == bool:
    if Import == True:
        try:
            importSitefolder(geoJSONFolderPath)
            if guidList != None:
                message = 'You succesfully imported a geoJSON file!' 
            else:
                message = 'There was some problem with your geoJSON file, we imported as many layers as possible!'
                
        except:
            pass
else:
    print 'To Import you need to input a boolean toggle'

Geometry = DataTree[Object]()
Attributes = DataTree[Object]()
Values = DataTree[Object]()
LayerNames = DataTree[Object]()

### NOTE: some problems with mutlipolygons being nested 'up' a level. This problem is rooted in 'loader'
### it needs to be debugged out
print layerNamesOut
for i in range (len(layerNamesOut[0])):
    p = GH_Path(i)
    LayerNames.Add(layerNamesOut[0][i]['name'],p)
    
for A in idsOut:#for each file
    for i in range (len(A)):# for each layer
        try:
            p = GH_Path(i)#make a new data tree path
            if (len(A[i])>1):# if the datatree path has more than one item
                for j in range (len(A[i])):# iterate
                    try:
                        thisId = A[i][j][0]
                        pPrime = p.AppendElement(j)
                        Geometry.Add(thisId,p)# add each feature to the path
                        getAttsVals(thisId,pPrime)
                    except:
                        ### It must be a point (tuple), cannot subscript it, grab it directly
                        try:
                            thisId = A[i][j]
                            pPrime = p.AppendElement(j)
                            Geometry.Add(thisId,p)
                            getAttsVals(thisId,pPrime)
                        except:
                            continue
            else:#otherwise, the layer has only one item (it is either a 1 item layer or a multipolygon)
                #it is a single object layer
                try:
                    thisId = A[i][0]
                    pPrime = p.AppendElement(0)
                    Geometry.Add(thisId,p)
                    getAttsVals(thisId,pPrime)
                except: #multipolygon is nested one level
                    print "Multipolygon found, some list-cleanup may be needed"
                    thisId = A[i][0][0]
                    pPrime = p.AppendElement(0)
                    Geometry.Add(thisId,p)
                    getAttsVals(thisId,pPrime)
        except:
            print 'There were some problems importing a layer, please try again with a different set of layers'
            continue
# ---------- end import_geojson ----------
number_slider_6 = Slider(16, range=0..17)  # disabled
concat_2 = Concatenate(FragmentA=concat, FragmentB=int)  # disabled
panel_8 = Panel("groundsurface")  # disabled
sort_2 = SortList(Keys=pdecon_2.ZComponent, ValuesA=debrep_3.Faces)  # -> Keys, ValuesA
toggle_2 = BooleanToggle(False)  # disabled
pt = Point(Point(0, 0, 0))
concat_3 = Concatenate(FragmentA=concat_2, FragmentB=panel_7)  # disabled
item_2 = ListItem(List=sort_2.ValuesA, Index=0, Wrap=True)
localcodeimport = LocalCodeImport(FilePathsForImport=concat_3, LayersToImport=panel_8, OnOffSwitch=toggle_2, DeleteExistingGeometry=toggle_2)  # disabled
evalsrf = EvaluateSurface(Surface=item_2, Point=pt)  # -> Point, Normal, Frame
select_a_layer_from_geojson = SelectALayerFromGeoJSON(
    layer_number=number_slider_6,
    geometry_lists=import_geojson.Geometry,
    gis_attributes=import_geojson.Attributes,
    gis_values=import_geojson.Values,
    layer_list=import_geojson.LayerNames)  # -> geometry, gis_attributes_2, gis_values_2, layer_name; disabled
Y = UnitY(Factor=1)
contour = Contour(Shape=geo_5, Point=evalsrf.Point, Direction=Y, Distance=Slider(5, range=0..10))  # -> simplify(Contours)
cp = ControlPoints(Curve=contour)  # -> Points, Weights, Knots
path_mapper = PathMapper(cp.Points, source="{A;B}", target="{A}")
sort_pt = SortPoints(Points=path_mapper)  # -> Points, Indices
loft_opt = LoftOptions(Closed=False, Adjust=Toggle(False), Rebuild=Slider(13, range=0..100), Refit=0, Type=0)
pline = PolyLine(Vertices=sort_pt.Points, Closed=False)  # -> flatten(Polyline)
loft = Loft(Curves=pline, Options=loft_opt)
geo_6 = Geometry(loft)

# ---- group: TerrainNurbs
geo_7 = Geometry(geo_6)

# ----
bbox_3 = BoundingBox(Content=geo_7, Plane=PlaneXY(0, 0, 0))  # -> Box, Box_2
debrep_4 = DeconstructBrep(Brep=bbox_3.Box)  # -> Faces, Edges, Vertices
area_5 = Area(Geometry=debrep_4.Faces)  # -> Area, Centroid
pdecon_3 = Deconstruct(Point=area_5.Centroid)  # -> XComponent, YComponent, ZComponent
sort_3 = SortList(Keys=pdecon_3.ZComponent, ValuesA=debrep_4.Faces)  # -> Keys, ValuesA
item_3 = ListItem(List=sort_3.ValuesA, Index=0, Wrap=True)
dedom2 = DeconstructDomain²(Domain=item_3)  # -> UComponent, VComponent
dedomain = DeconstructDomain(Domain=dedom2.UComponent)  # -> Start, End
dedomain_2 = DeconstructDomain(Domain=dedom2.VComponent)  # -> Start, End
integer_division = IntegerDivision(A=dedomain.End, B=number_slider_2)
integer_division_2 = IntegerDivision(A=dedomain_2.End, B=number_slider_2)
sdivide = DivideSurface(Surface=item_3, UCount=integer_division, VCount=integer_division_2)  # -> Points, Normals, Parameters
area_6 = Area(Geometry=item_3)  # -> Area, Centroid
integer_division_3 = IntegerDivision(A=area_6.Area, B=Slider(1200, range=0..1500))
line = LineSDL(Start=sdivide.Points, Direction=Vector(0, 0, 1), Length=number_slider_4)  # disabled
scx = SurfaceLine(Surface=geo_7, Line=line, LimitToFirst=False)  # -> Curves, flatten(Points), UVPoints, Normal; disabled
popgeo = PopulateGeometry(Geometry=geo_7, Count=integer_division_3, Seed=1)
pdecon_4 = Deconstruct(Point=popgeo)  # -> XComponent, YComponent, ZComponent; disabled
panel_9 = Panel(pdecon_4.ZComponent)  # disabled
terrain_trace = PythonScript(
    startPoint=popgeo,
    terrainSurface=geo_7,
    stepSize=Slider(1, range=0..10),
    maxSteps=Slider(250, range=0..4000),
    tol=Slider(0, range=0..1))  # -> out, a; inputs startPoint: Point3d, terrainSurface: Surface
# ---------- terrain_trace: Python ----------
import Rhino
 
class DrainBoid(object):
    def __init__(self, point3d, surface, stepsize=0.5, maxsteps=None, tolerance=0.001):
        self.start = point3d
        self.pos = self.start
        result, self.u, self.v = surface.ClosestPoint(self.pos)
        self.surface = surface
        self.stepsize = stepsize
        self.points = [self.start]
        self.state = 'on'
        self.tolerance = tolerance
        self.maxsteps = maxsteps
     
    def makeDrainCurve(self):
        i = 0
        while self.state == 'on':
            i += 1
            if self.maxsteps:
                if i >= self.maxsteps:
                    self.state = 'finished'
            self.nextStep()
        return Rhino.Geometry.Curve.CreateControlPointCurve(self.points, 1)
         
    def nextStep(self):
        result, newFrame = self.surface.FrameAt(self.u, self.v)
        # create a vector from newFrame XAxis
        downVect = newFrame.XAxis
        # figure out hw far to rotate it.
        deltaAngle = Rhino.Geometry.Vector3d.VectorAngle( downVect, Rhino.Geometry.Vector3d(0.0, 0.0, -1.0), newFrame )
        # rotate it in the plane
        downVect.Rotate( deltaAngle, newFrame.ZAxis)
        # set the length
        downVect = downVect.Multiply( self.stepsize, downVect )
        spacePoint = Rhino.Geometry.Point3d.Add(self.pos, downVect)
        result, self.u, self.v = self.surface.ClosestPoint(spacePoint)
        out, newPoint, vects = self.surface.Evaluate(self.u, self.v, 0)
        if newPoint.Z >= self.pos.Z: # if higher
            self.state = 'finished'
        elif not self.checkTolerance(newPoint): # if too close
            self.state = 'finished'
        else:
            self.updatePos( newPoint )
     
    def updatePos(self, newPoint):
        self.points.append(newPoint)
        self.pos = newPoint
     
    def checkTolerance(self, other):
        # checks against another point
        # if it is outside of tolerance, returns True
        return self.pos.DistanceTo( other ) > self.tolerance
 
if terrainSurface:
    b = DrainBoid(startPoint, terrainSurface, stepSize, maxSteps, tol)
    print b.points
    a = b.makeDrainCurve()
# ---------- end terrain_trace ----------
geo_8 = Geometry(terrain_trace.a)
geo_9 = Geometry(geo_8)
project_4 = Project(Geometry=geo_9, Plane=PlaneXY(0, 0, 0))  # -> Geometry, Transform
bcx = BrepCurve(Brep=boundary, Curve=project_4.Geometry)  # -> Curves, Points
ccx = CurveCurve(CurveA=project.Geometry, CurveB=project_4.Geometry)  # -> Points, ParamsA, ParamsB
viewer_2 = ParamViewer(bcx.Curves)
item_4 = TreeItem(Tree=bcx.Curves, Path=viewer_2, Index=0, Wrap=True)
null = NullItem(Item=item_4)  # -> NullFlags, InvalidFlags, Description
cull_2 = CullPattern(List=project_4.Geometry, CullPattern=null.NullFlags)
geo_10 = Geometry(cull_2)

# ---- group: outside drainage lines that don't intersect intervention
geo_11 = Geometry(geo_10)

# ----
pickler = Pickler(data=geo_6, siteNumber=number_slider, layer="TerrainNurbs", path=pickles, write=Toggle(True))  # -> out, geometry; inputs data: list of GeometryBase
# ---------- pickler: Python ----------
import cPickle as pickle

if path and data and write:
    if siteNumber:
        f = open(path+str(int(siteNumber))+layer, 'wb')
    else:
        f = open(path+layer, 'wb')
    pickle.dump(data, f)
    f.close()
    fcheck = open(path+str(int(siteNumber))+layer)
    geometry = pickle.load(fcheck)
    fcheck.close()
# ---------- end pickler ----------
geo_12 = Geometry(pickler.geometry)

toggle_3 = BooleanToggle(True)
pickler_2 = Pickler(data=flatten(geo_11), siteNumber=number_slider, layer="Linework_Drainage_Lines_NonSite", path=pickles, write=toggle_3)  # -> out, geometry; inputs data: list of GeometryBase; same code as pickler

path_4 = ConstructPath(Indices=mindex_4.Index)
number_slider_7 = Slider(34, range=0..100)
number_slider_8 = Slider(90, range=0..100)
branch_4 = TreeBranch(Tree=geo_2, Path=path_4, MaintainPaths=True)

# ---- group: intervention outline
geo_13 = Geometry(branch_4)

# ---- group: accomodate different classes of site outlines
lng = ListLength(List=branch_3)
equals = Equality(FirstNumber=lng, SecondNumber="1")  # -> Equality, Inequality
dispatch = Dispatch(List=branch_3, DispatchPattern=equals.Equality)  # -> ListA, ListB
project_5 = Project(Geometry=dispatch.ListB, Plane=PlaneXY(0, 0, 0))  # -> Geometry, Transform
runion = RegionUnion(Curves=project_5.Geometry)
geo_14 = Geometry(runion)
project_6 = Project(Curve=geo_14, Brep=geo_7, Direction=" 0,0,1")

# ----
null_2 = NullItem(Item=runion)  # -> NullFlags, InvalidFlags, Description
dispatch_2 = Dispatch(List=project_5.Geometry, DispatchPattern=null_2.NullFlags)  # -> ListA, ListB
len = Length(Curve=dispatch_2.ListA)
sort_4 = SortList(Keys=len, ValuesA=dispatch_2.ListA)  # -> Keys, ValuesA
item_5 = ListItem(List=reverse(sort_4.ValuesA), Index=0, Wrap=True)
project_7 = Project(Curve=item_5, Brep=geo_7, Direction=" 0,0,1")

# ---- group: accomodate different classes of site outlines (continued)
merge = Merge(Data1=dispatch.ListA, Data2=project_6, Data3=project_7)  # -> flatten(Result)

# ----
flatten = FlattenTree(Tree=merge, Path="{0}")
len_2 = Length(Curve=flatten)
ma = MassAddition(Input=len_2)  # -> Result, PartialResults
sort_5 = SortList(Keys=len_2, ValuesA=flatten)  # -> Keys, ValuesA
item_6 = ListItem(List=reverse(sort_5.Keys), Index=0, Wrap=True)
item_7 = ListItem(List=reverse(sort_5.ValuesA), Index=0, Wrap=True)
integer_division_4 = IntegerDivision(A=ma.Result, B=lineyness)
popgeo_2 = PopulateGeometry(Geometry=flatten, Count=integer_division_4, Seed=1)
terrain_trace_up = PythonScript(
    startPoint=popgeo_2,
    terrainSurface=geo_7,
    stepSize=Slider(1, range=0..10),
    maxSteps=Slider(250, range=0..4000),
    tol=Slider(0, range=0..1))  # -> out, a; inputs startPoint: Point3d, terrainSurface: Surface
# ---------- terrain_trace_up: Python ----------
import Rhino
 
class DrainBoid(object):
    def __init__(self, point3d, surface, stepsize=0.5, maxsteps=None, tolerance=0.001):
        self.start = point3d
        self.pos = self.start
        result, self.u, self.v = surface.ClosestPoint(self.pos)
        self.surface = surface
        self.stepsize = stepsize
        self.points = [self.start]
        self.state = 'on'
        self.tolerance = tolerance
        self.maxsteps = maxsteps
     
    def makeDrainCurve(self):
        i = 0
        while self.state == 'on':
            i += 1
            if self.maxsteps:
                if i >= self.maxsteps:
                    self.state = 'finished'
            self.nextStep()
        return Rhino.Geometry.Curve.CreateControlPointCurve(self.points, 1)
         
    def nextStep(self):
        result, newFrame = self.surface.FrameAt(self.u, self.v)
        # create a vector from newFrame XAxis
        upVect = newFrame.XAxis
        # figure out hw far to rotate it.
        deltaAngle = Rhino.Geometry.Vector3d.VectorAngle( upVect, Rhino.Geometry.Vector3d(0.0, 0.0, 1.0), newFrame )
        # rotate it in the plane
        upVect.Rotate( deltaAngle, newFrame.ZAxis)
        # set the length
        upVect = upVect.Multiply( self.stepsize, upVect )
        spacePoint = Rhino.Geometry.Point3d.Add(self.pos, upVect)
        result, self.u, self.v = self.surface.ClosestPoint(spacePoint)
        out, newPoint, vects = self.surface.Evaluate(self.u, self.v, 0)
        if newPoint.Z <= self.pos.Z: # if lower
            self.state = 'finished'
        elif not self.checkTolerance(newPoint): # if too close
            self.state = 'finished'
        else:
            self.updatePos( newPoint )
     
    def updatePos(self, newPoint):
        self.points.append(newPoint)
        self.pos = newPoint
     
    def checkTolerance(self, other):
        # checks against another point
        # if it is outside of tolerance, returns True
        return self.pos.DistanceTo( other ) > self.tolerance
 
if terrainSurface:
    b = DrainBoid(startPoint, terrainSurface, stepSize, maxSteps, tol)
    a = b.makeDrainCurve()
# ---------- end terrain_trace_up ----------
geo_15 = Geometry(terrain_trace_up.a)

# ---- group: drainage lines from outline
geo_16 = Geometry(geo_15)

# ----
pickler_3 = Pickler(data=flatten(geo_16), siteNumber=number_slider, layer="Linework_Drainage_Lines_Site", path=pickles, write=toggle_3)  # -> out, geometry; inputs data: list of GeometryBase; same code as pickler

cp_2 = ControlPoints(Curve=terrain_trace_up.a)  # -> Points, Weights, Knots

project_8 = Project(Geometry=geo_13, Plane=PlaneXY(0, 0, 0))  # -> Geometry, Transform
bbox_4 = BoundingBox(Content=project_8.Geometry, Plane=PlaneXY(0, 0, 0), UnionBox=True)  # -> Box, Box_2
debrep_5 = DeconstructBrep(Brep=bbox_4.Box)  # -> Faces, Edges, Vertices
area_7 = Area(Geometry=debrep_5.Faces)  # -> Area, Centroid
join_2 = JoinCurves(Curves=debrep_5.Edges, Preserve=False)
len_3 = Length(Curve=join_2)
division = Division(A=len_3, B=Slider(23, range=0..100))
offset = Offset(Curve=join_2, Distance=division, Plane=PlaneXY(0, 0, 0), Corners=1)

# ---- group: view curve
crv = Curve(offset)

crv_2 = Curve(crv)

# ----
create_view = CreateView(geometry=crv_2, azimuth_angle=number_slider_8, altitude=number_slider_7)  # -> geometry_2, view_vector, view_target, view_components
pickle_view = PickleView_2(
    geometry=create_view.geometry_2,
    azimuth_angle=number_slider_8,
    altitude=number_slider_7,
    site_number=number_slider,
    path=pickles,
    write=Toggle(True))  # -> geometry_2, view_vector, view_target
set_view = SetView(setView=Toggle(True), geometry=create_view.geometry_2, vector=create_view.view_vector, target=create_view.view_target)  # -> out, a; inputs geometry: GeometryBase, vector: Vector3d, target: Point3d
# ---------- set_view: Python ----------
import os
import time

import Rhino
import cPickle as pickle
import rhinoscriptsyntax as rs
from scriptcontext import doc


if setView:
    vp = doc.Views.ActiveView.ActiveViewport
    vp.SetCameraDirection( vector, True)
    vp.SetCameraTarget(target, True)
    bb = geometry.GetBoundingBox(True)
    vp.ZoomBoundingBox( bb)
    doc.Views.ActiveView.Redraw()
# ---------- end set_view ----------

# ==== cluster CreateView: Create a Rhino view
azimuth_angle = ClusterInput()  # Enter the azimuth rotation angle (degrees).
geometry = ClusterInput()  # Input the site geometry. The geometry should be a curve.
altitude = ClusterInput()  # Enter the Altitude rotation angle in degrees.
cp = ControlPoints(Curve=geometry)  # -> Points, Weights, Knots
Y = UnitY(Factor=1)
eval = Evaluate(F="x*pi/180", x=azimuth_angle)
eval_2 = Evaluate(F="x*pi/180", x=altitude)
pline = PolyLine(Vertices=cp.Points, Closed=False)
rev = Reverse(Vector=Y)
Z = UnitZ(Factor=1)
pcen = PolygonCenter(Polyline=pline)  # -> CenterV, CenterE
vrot = Rotate(Vector=rev, Axis=Z, Angle=eval)
Z_2 = UnitZ(Factor=1)
pl = Plane(Origin=pcen.CenterV, XAxis=vrot, YAxis=Z_2)
multiplication = Multiplication(A=eval_2, B="-1")
rotate = Rotate(Geometry=pl, Angle=multiplication, Plane=pl)  # -> Geometry, Transform
pcomp = PlaneComponents(Plane=rotate.Geometry)  # -> Origin, XAxis, YAxis, ZAxis
geo = Geometry(flatten([geometry, pcomp.XAxis, pcomp.Origin]))
geometry_2 = ClusterOutput(pline)  # Site Geometry.
view_vector = ClusterOutput(pcomp.XAxis)  # View Orientation Vector.
view_target = ClusterOutput(pcomp.Origin)  # View Target Point.
view_components = ClusterOutput(geo)  # View Components ready to be pickled.

# ==== cluster PickleView_2: Pickle a Rhino view
geometry = ClusterInput()  # Input the site geometry. The geometry should be a curve.
azimuth_angle = ClusterInput()  # Enter the azimuth rotation angle (degrees).
altitude = ClusterInput()  # Enter the Altitude rotation angle in degrees.
site_number = ClusterInput()  # Input a site number for the pickled view.
path = ClusterInput()  # Enter a path to save the pickle.
write = ClusterInput()  # Do you want to write the Pickle? Enter a boolean,
pickle_view = PickleView(geometry=geometry, azimuth_angle=azimuth_angle, altitude=altitude)  # -> geometry_2, view_vector, view_target, view_components
layer_name = Panel("view")
python = PythonScript(geom=geometry, vec=pickle_view.view_vector, pt=pickle_view.view_target)  # -> out, a; inputs geom: Polyline, vec: Vector3d, pt: Point3d
# ---------- python: Python ----------
a = [geom,vec,pt]
# ---------- end python ----------
pickler = PythonScript(data=python.a, siteNumber=site_number, layer=layer_name, path=path, write=write)  # -> out, geometry; inputs data: list of GeometryBase
# ---------- pickler: Python ----------
import cPickle as pickle
import Rhino

if path and data and write:
    if siteNumber:
        f = open(path+str(int(siteNumber))+layer, 'wb')
    else:
        f = open(path+layer, 'wb')
    new_data = [data[0],Rhino.Geometry.Point3d(data[1].Location),Rhino.Geometry.Point3d(data[2].Location)]
    pickle.dump(new_data, f)
    f.close()
    fcheck = open(path+str(int(siteNumber))+layer)
    geometry = pickle.load(fcheck)[0]

    fcheck.close()
# ---------- end pickler ----------
geometry_2 = ClusterOutput(pickler.geometry)  # Site Geometry.
view_vector = ClusterOutput(pickle_view.view_vector)  # View Orientation Vector.
view_target = ClusterOutput(pickle_view.view_target)  # View Target Point.

# ==== cluster SelectALayerFromGeoJSON: Select a specific layer from a group of layers imported from a geoJSON
layer_number = ClusterInput()  # Select a layer from the geoJSON. Input an integer
geometry_lists = ClusterInput()  # Input geometry lists from geJSON
gis_attributes = ClusterInput()  # Input list of GIS attributes from geoJSON.
layer_list = ClusterInput()  # List of Layers.
gis_values = ClusterInput()  # Input list of GIS values from geoJSON
int = Integer(layer_number)
item = ListItem(List=flatten(layer_list), Index=expr("x-1", int), Wrap=False)
rep = ReplaceString(String="{X;*}", Find="X", Replace=int, RecursiveReplace=False)
tsplit = SplitTree(Data=gis_attributes, Masks=rep)  # -> Positive, Negative
tsplit_2 = SplitTree(Data=gis_values, Masks=rep)  # -> Positive, Negative
tsplit_3 = SplitTree(Data=geometry_lists, Masks=rep)  # -> graft(Positive), Negative
gis_attributes_2 = ClusterOutput(tsplit.Positive)  # Selected layer's GIS attributes.
gis_values_2 = ClusterOutput(tsplit_2.Positive)  # List of selected layer's GIS Values.
geometry = ClusterOutput(tsplit_3.Positive)  # List of geometry for selected layer.
layer_name = ClusterOutput(item)  # Name of Selected Layer.

# ==== cluster PickleView
azimuth_angle = ClusterInput()  # Enter the azimuth rotation angle (degrees).
geometry = ClusterInput()  # Input the site geometry. The geometry should be a curve.
altitude = ClusterInput()  # Enter the Altitude rotation angle in degrees.
cp = ControlPoints(Curve=geometry)  # -> Points, Weights, Knots
Y = UnitY(Factor=1)
eval = Evaluate(F="x*pi/180", x=azimuth_angle)
eval_2 = Evaluate(F="x*pi/180", x=altitude)
pline = PolyLine(Vertices=cp.Points, Closed=False)
rev = Reverse(Vector=Y)
Z = UnitZ(Factor=1)
pcen = PolygonCenter(Polyline=pline)  # -> CenterV, CenterE
vrot = Rotate(Vector=rev, Axis=Z, Angle=eval)
Z_2 = UnitZ(Factor=1)
pl = Plane(Origin=pcen.CenterV, XAxis=vrot, YAxis=Z_2)
multiplication = Multiplication(A=eval_2, B="-1")
rotate = Rotate(Geometry=pl, Angle=multiplication, Plane=pl)  # -> Geometry, Transform
pcomp = PlaneComponents(Plane=rotate.Geometry)  # -> Origin, XAxis, YAxis, ZAxis
pt = Point(pcomp.Origin)
geo = Geometry(flatten([pt, pcomp.XAxis, geometry]))
geometry_2 = ClusterOutput(pline)  # Site Geometry.
view_vector = ClusterOutput(pcomp.XAxis)  # View Orientation Vector.
view_target = ClusterOutput(pcomp.Origin)  # View Target Point.
view_components = ClusterOutput(geo)  # View Components ready to be pickled.
