# Grasshopper definition 03_siteplanemaker.gh (Grasshopper 0.9.76)
# plug-ins: LocalCode, Python Interpreter, LunchBox

panel = Panel("""fullterrainmesh
Data_CNN""")
number_slider = Slider(12, range=1..1375)
drive = Panel("F")
toggle = BooleanToggle(True)
concat = Concatenate(FragmentA=drive, FragmentB=":\Local Code\Work\Local Code - Los Angeles\06 DB\")
unpickle_geometry = UnPickleGeometry(siteNumber=number_slider, layer=panel, path=concat, read=Toggle(True))  # -> out, simplify(geometry)
# ---------- unpickle_geometry: Python ----------
import cPickle as pickle

if path and read and layer:
    try:
        if siteNumber:
            f = open(path+str(int(siteNumber))+layer)
        else:
            f = open(path+layer)
        geometry = pickle.load(f)
        f.close()

    except:
        print 'problem loading %s\nfile may not exist' % path+str(int(siteNumber))+layer
# ---------- end unpickle_geometry ----------
panel_2 = Panel("""SiteNumber
CNN""")
panel_3 = Panel(unpickle_geometry.geometry)
bang = ExplodeTree(Data=unpickle_geometry.geometry)  # -> Branch0, Branch1
excelwrite = ExcelWrite(
    WriteToggle=toggle,
    WriteHeading=False,
    ClearSheet=False,
    Worksheet=1,
    ColumnStart=1,
    RowStart=number_slider,
    ColumnHeadings=panel_2,
    Column1=number_slider,
    Column2=bang.Branch1)
panel_4 = Panel(":\Local Code\Work\Local Code - San Francisco\06 DB\site_planes\")
concat_2 = Concatenate(FragmentA=drive, FragmentB=panel_4)
concat_3 = Concatenate(FragmentA=concat_2, FragmentB=bang.Branch1)
mshadow = MeshShadow(Mesh=bang.Branch0, Light=Vector(0, 0, -1), Plane=PlaneXY(0, 0, 0))
concat_4 = Concatenate(FragmentA=concat_3, FragmentB=".3dm")
boundary = BoundarySurfaces(Edges=mshadow)
localcodeexport = LocalCodeExport(DestinationFilePath=concat_4, Export=toggle, LayerNames="site_plane", GeometryTree=boundary)
