# Grasshopper definition 04-rendersiteplanes.gh (Grasshopper 0.9.69)
# plug-ins: LocalCode, Python Interpreter

number_slider = Slider(1, range=1..50)
panel = Panel("G:\Local Code\Work\Local Code - San Francisco\06 DB\Pickles\")
toggle = BooleanToggle(True)
int = Integer(number_slider)
concat = Concatenate(FragmentA="G:\Local Code\Work\Local Code - San Francisco\05-Rhino\", FragmentB=int)
concat_2 = Concatenate(FragmentA=concat, FragmentB=".3dm")
unpickle_view = UnpickleView(siteNumber=number_slider, path=panel, UnPickle=toggle)  # -> out, geometry, vector, target
# ---------- unpickle_view: Python ----------
import os
import time

import Rhino
import cPickle as pickle
import rhinoscriptsyntax as rs
from scriptcontext import doc

if UnPickle:
    f = open(path + '%sview' % int(siteNumber), 'rb')
    view = pickle.load(f)
    f.close()
    if len(view) == 3:
        geometry = view[0]
        vector = Rhino.Geometry.Vector3d(view[1])
        target = view[2]
    else:
        print 'bad view data'
    
    vp = doc.Views.ActiveView.ActiveViewport
    vp.SetCameraDirection( vector, True)
    vp.SetCameraTarget(target, True)
    bb = geometry.GetBoundingBox(True)
    vp.ZoomBoundingBox( bb)
    doc.Views.ActiveView.Redraw()
    #return view
# ---------- end unpickle_view ----------
localcodeimport = LocalCodeImport(FilePathsForImport=concat_2, LayersToImport="site_plane", OnOffSwitch=toggle, DeleteExistingGeometry=toggle)
panel_2 = Panel("G:\Local Code\Work\Local Code - San Francisco\06 DB\site_renders\")
set_view = SetView(setView=Toggle(True), geometry=unpickle_view.geometry, vector=unpickle_view.vector, target=unpickle_view.target)  # -> out, a; inputs geometry: GeometryBase, vector: Vector3d, target: Point3d
# ---------- set_view: Python ----------
import os
import time

import Rhino
import cPickle as pickle
import rhinoscriptsyntax as rs
from scriptcontext import doc


if setView:
    vp = doc.Views.ActiveView.ActiveViewport
    vp.SetCameraDirection( vector, True)
    vp.SetCameraTarget(target, True)
    bb = geometry.GetBoundingBox(True)
    vp.ZoomBoundingBox( bb)
    doc.Views.ActiveView.Redraw()
# ---------- end set_view ----------
batch_render = BatchRender(Path=panel_2, Site=number_slider, fileExtension=".png", Render=Toggle(False))  # -> out
# ---------- batch_render: Python ----------
import Rhino

def rcmd(commandstring, echo=True, mask=True):
    if mask:
        premask = '-_%s '
        try:
            cmd = premask % commandstring
        except:
            print commandstring, 'failed to mask'
    else:
        cmd = commandstring
    result = Rhino.RhinoApp.RunScript(cmd, echo)
    if not result:
        print 'The following command failed:'
        print ' ',cmd
    return result

def rcmds(commands, echo=True, mask=True):
    for cmd in commands:
        rcmd( cmd, echo, mask )

savedLocation = str(Path) + str(int(Site)) + str(fileExtension)

if Render: 
    rcmds(['Render',"SaveRenderWindowAs \n\"" + savedLocation + "\"\n", "CloseRenderWindow"])
# ---------- end batch_render ----------
