# Grasshopper definition 04B-SiteFlowlinesArrows A.gh (Grasshopper 0.9.76)
# plug-ins: Python Interpreter

panel = Panel("""Linework_InterventionOutlines
Linework_Drainage_Lines_Site""")
number_slider = Slider(1374, range=1..1374)
panel_2 = Panel("F:\Local Code\Work\Local Code - San Francisco\06 DB\Pickles\")
unpickle_geometry = UnPickleGeometry(siteNumber=number_slider, layer="Data_CNN", path=panel_2, read=panel_2)  # -> out, geometry
# ---------- unpickle_geometry: Python ----------
import cPickle as pickle

if path and read and layer:
    try:
        if siteNumber:
            f = open(path+str(int(siteNumber))+layer)
        else:
            f = open(path+layer)
        geometry = pickle.load(f)
        f.close()

    except:
        print 'problem loading %s\nfile may not exist' % path+str(int(siteNumber))+layer
# ---------- end unpickle_geometry ----------
unpickle_geometry_2 = UnPickleGeometry(siteNumber=number_slider, layer=panel, path=panel_2, read=Toggle(True))  # -> out, simplify(geometry); same code as unpickle_geometry

# ---- group: lines n geometry
geo = Geometry(unpickle_geometry_2.geometry)

# ----
bang = ExplodeTree(Data=geo)  # -> Branch0, Branch1

# ---- group: lines
geo_2 = Geometry(bang.Branch1)

# ---- group: only keep the arrows of the top 15% in size / Find Printed Width in MM from Excel File Generated by Catalogtree
panel_3 = Panel("C:\Users\Carlos Emilio\Documents\Github\SF-grasshopper\Filename and Funding Only_result.csv")
file = ReadFile(File=panel_3, PerLineParse=True)
split = TextSplit(Text=file, Separators=",")
item = ListItem(List=split, Index=Slider(8, range=0..10), Wrap=True)  # -> flatten(Item)
item_2 = ListItem(List=split, Index=Slider(2, range=0..10), Wrap=True)  # -> flatten(Item)
mindex = MemberIndex(Set=item_2, Member=unpickle_geometry.geometry)  # -> Index, Count
item_3 = ListItem(List=item, Index=mindex.Index, Wrap=True)

# ---- group: intervention outline
geo_3 = Geometry(bang.Branch0)

# ----
size_of_printed_y_dimension_in_mm = Slider(210, range=0..1000)
pi = Pi(Factor=Slider(0.16, range=0..1))
Z = UnitZ(Factor=1)
neg = Negative(Value=pi)

project = Project(Geometry=geo_3, Plane=PlaneXY(0, 0, 0))  # -> Geometry, Transform
bbox = BoundingBox(Content=project.Geometry, Plane=PlaneXY(0, 0, 0), UnionBox=True)  # -> Box, Box_2
debrep = DeconstructBrep(Brep=bbox.Box)  # -> Faces, Edges, Vertices
area = Area(Geometry=debrep.Faces)  # -> Area, Centroid
join = JoinCurves(Curves=debrep.Edges, Preserve=False)
len = Length(Curve=join)
division = Division(A=len, B=Slider(23, range=0..100))
offset = Offset(Curve=join, Distance=division, Plane=PlaneXY(0, 0, 0), Corners=1)

multiplication = Multiplication(A=size_of_printed_y_dimension_in_mm, B=Slider(1.8, range=0..10))
colour = ColourPicker(PickedColour=RGB(255, 255, 255))

# ---- group: view curve
crv = Curve(offset)

crv_2 = Curve(crv)

# ----
dim = Dimensions(Surface=crv_2)  # -> UDimension, VDimension
merge = Merge(Data1=dim.UDimension, Data2=dim.VDimension)
sort = SortList(Keys=merge)  # -> Keys, ValuesA
item_4 = ListItem(List=reverse(sort.Keys), Index=0, Wrap=True)

# ---- group: y dimension
num = Number(item_4)

# ----
division_2 = Division(A=num, B=multiplication)

# ---- group: mm size for this design
num_2 = Number(division_2)

# ---- group: local mm
num_3 = Number(num_2)

num_4 = Number(num_3)

# ----
multiplication_2 = Multiplication(A=num_4, B=Slider(11, range=0..100))
multiplication_3 = Multiplication(A=multiplication_2, B=Slider(0.14, range=0..0.2))
merge_2 = Merge(Data1=multiplication_2, Data2=multiplication_3)
dash = DashPattern(Curve=geo_2, Pattern=merge_2)  # -> simplify(Dashes), Gaps
eval = EvaluateCurve(Curve=reparameterize(dash.Dashes), Parameter=Slider(0, range=0..100))  # -> Point, Tangent, Angle
vrot = Rotate(Vector=eval.Tangent, Axis=Z, Angle=pi)
vrot_2 = Rotate(Vector=eval.Tangent, Axis=Z, Angle=neg)
multiplication_4 = Multiplication(A=num_4, B=Slider(1.6, range=0..5))
line = LineSDL(Start=eval.Point, Direction=vrot, Length=multiplication_4)
line_2 = LineSDL(Start=eval.Point, Direction=vrot_2, Length=multiplication_4)
merge_3 = Merge(Data1=dash.Dashes, Data2=line, Data3=line_2)  # -> flatten(Result)

# ---- group: only keep the arrows of the top 15% in size
sort_2 = SortList(Keys=item)  # -> Keys, ValuesA
lng = ListLength(List=sort_2.Keys)
multiplication_5 = Multiplication(A=lng, B=Slider(0.85, range=0..1))
item_5 = ListItem(List=sort_2.Keys, Index=multiplication_5, Wrap=True)
larger = LargerThan(FirstNumber=item_3, SecondNumber=item_5)  # -> LargerThan, OrEqualTo
filter = StreamFilter(Gate=larger.OrEqualTo, Stream1=merge_3)

# ----
preview = CustomPreview(Geometry=merge_3, Shader=colour)
pickler = Pickler(data=filter, siteNumber=number_slider, layer="Linework_Site_Flowlines_Arrows", path=panel_2, write=Toggle(True))  # -> out, geometry; inputs data: list of GeometryBase
# ---------- pickler: Python ----------
import cPickle as pickle

if path and data and write:
    if siteNumber:
        f = open(path+str(int(siteNumber))+layer, 'wb')
    else:
        f = open(path+layer, 'wb')
    pickle.dump(data, f)
    f.close()
    fcheck = open(path+str(int(siteNumber))+layer)
    geometry = pickle.load(fcheck)
    fcheck.close()
# ---------- end pickler ----------
