# Grasshopper definition 05_IllustratorExport with delay B.gh (Grasshopper 0.9.69)
# plug-ins: LocalCode, Python Interpreter, LunchBox

toggle = BooleanToggle(True)
# REMEMBER TO SET ILLUSTRATOR EXPORT OPTIONS IN RHINO
number_slider = Slider(200, range=1..200)
panel = Panel("""Linework_Buildings
Linework_Cityfeatures
Linework_CityLots
Linework_Drainage_Lines_NonSite
Linework_InterventionOutlines
Linework_Path_Edges
Linework_Pathway_Hatch
Linework_Shadows01_Equinox
Linework_Shadows02_Summer
Linework_Shadows03_Winter
Linework_SiteCenterline
Linework_SurfaceOutlines
Linework_Garden_Hatch
Linework_Tree_Hatch
Linework_Hardscape_Hatch
Linework_Orchard_Hatch
Linework_Wetland_Hatch
Linework_Wide_Drainage_Lines_Site
Surface_Core
Data_CNN""")
panel_2 = Panel("D:\Local Code\Work\Local Code - San Francisco\06 DB\Pickles\")
mindex = MemberIndex(Set=panel, Member="Data_CNN")  # -> Index, Count
unpickle_geometry = UnPickleGeometry(siteNumber=number_slider, layer=panel, path=panel_2, read=toggle)  # -> out, simplify(geometry)
# ---------- unpickle_geometry: Python ----------
import cPickle as pickle

if path and read and layer:
    try:
        if siteNumber:
            f = open(path+str(int(siteNumber))+layer)
        else:
            f = open(path+layer)
        geometry = pickle.load(f)
        f.close()

    except:
        print 'problem loading %s\nfile may not exist' % path+str(int(siteNumber))+layer
# ---------- end unpickle_geometry ----------
unpickle_view = UnpickleView(siteNumber=number_slider, path=panel_2, UnPickle=toggle)  # -> out, geometry, vector, target
# ---------- unpickle_view: Python ----------
import os
import time

import Rhino
import cPickle as pickle
import rhinoscriptsyntax as rs
from scriptcontext import doc

if UnPickle:
    f = open(path + '%sview' % int(siteNumber), 'rb')
    view = pickle.load(f)
    f.close()
    if len(view) == 3:
        geometry = view[0]
        vector = Rhino.Geometry.Vector3d(view[1])
        target = view[2]
    else:
        print 'bad view data'
    
    vp = doc.Views.ActiveView.ActiveViewport
    vp.SetCameraDirection( vector, True)
    vp.SetCameraTarget(target, True)
    bb = geometry.GetBoundingBox(True)
    vp.ZoomBoundingBox( bb)
    doc.Views.ActiveView.Redraw()
    #return view
# ---------- end unpickle_view ----------
path = ConstructPath(Indices=mindex.Index)
panel_3 = Panel("""JSON
CNN""")
path_mapper = PathMapper(unpickle_view.geometry, source="{A}", target="{19}")
split = SplitTree(Data=unpickle_geometry.geometry, Masks=flatten(path))  # -> Positive, Negative
split_2 = SplitList(List=panel, Index=mindex.Index)  # -> ListA, ListB
merge = Merge(Data1=flatten(split_2.ListA), Data2=flatten("View_Curve"))

# ---- group: Make Sure Cell Headings Match!
excelwrite = ExcelWrite(
    WriteToggle=Toggle(True),
    WriteHeading=Toggle(True),
    ClearSheet=False,
    Worksheet=1,
    ColumnStart=1,
    RowStart=number_slider,
    ColumnHeadings=panel_3,
    Column1=number_slider,
    Column2=split.Positive)

# ----
geo = Geometry(split.Negative)
panel_4 = Panel("D:\Local Code\Work\Local Code - San Francisco\07 Illustrator\Export 02\")
merge_2 = Merge(Data1=geo, Data2=path_mapper)
int = Integer(number_slider)
concat = Concatenate(FragmentA=int, FragmentB="-")
concat_2 = Concatenate(FragmentA=panel_4, FragmentB=concat)
set_view = SetView(setView=toggle, geometry=unpickle_view.geometry, vector=unpickle_view.vector, target=unpickle_view.target)  # -> out, a; inputs geometry: GeometryBase, vector: Vector3d, target: Point3d
# ---------- set_view: Python ----------
import os
import time

import Rhino
import cPickle as pickle
import rhinoscriptsyntax as rs
from scriptcontext import doc

a = False
if setView:
    vp = doc.Views.ActiveView.ActiveViewport
    vp.SetCameraDirection( vector, True)
    vp.SetCameraTarget(target, True)
    bb = geometry.GetBoundingBox(True)
    vp.ZoomBoundingBox( bb)
    doc.Views.ActiveView.Redraw()
    
    import time
    
    time.sleep(20)
    
    a=True
    setView = False
# ---------- end set_view ----------
concat_3 = Concatenate(FragmentA=concat_2, FragmentB=split.Positive)
toggle_2 = BooleanToggle(False)
concat_4 = Concatenate(FragmentA=concat_3, FragmentB=".ai")
localcodeexport = LocalCodeExport(DestinationFilePath=concat_4, Export=set_view.a, LayerNames=merge, GeometryTree=merge_2)
