# Grasshopper definition 00-checker.gh (Grasshopper 0.9.69)
# plug-ins: Python Interpreter

panel = Panel("""Linework_InterventionOutlines
Linework_Wide_Drainage_Lines_Site
Linework_Drainage_Lines_Site""")
number_slider = Slider(31, range=1..1375)
panel_2 = Panel("D:\Local Code\Work\Local Code - San Francisco\06 DB\Pickles\")
unpickle_geometry = UnPickleGeometry(siteNumber=number_slider, layer="Data_CNN", path=panel_2, read=panel_2)  # -> out, geometry
# ---------- unpickle_geometry: Python ----------
import cPickle as pickle

if path and read and layer:
    try:
        if siteNumber:
            f = open(path+str(int(siteNumber))+layer)
        else:
            f = open(path+layer)
        geometry = pickle.load(f)
        f.close()

    except:
        print 'problem loading %s\nfile may not exist' % path+str(int(siteNumber))+layer
# ---------- end unpickle_geometry ----------
unpickle_geometry_2 = UnPickleGeometry(siteNumber=number_slider, layer=panel, path=panel_2, read=Toggle(True))  # -> out, simplify(geometry); same code as unpickle_geometry
