# Grasshopper definition 02-PicklestoCurbstoFlowlinesandCamera-H.gh (Grasshopper 0.9.76)
# plug-ins: Python Interpreter

# ---- group: Find Printed Width in MM from Excel File Generated by Catalogtree
path = FilePath("C:\Users\carlos\Documents\GitHub\Localcode-grasshopper\SF-grasshopper\Filename and Funding Only_result.csv")
panel = Panel(path)
file = ReadFile(File=panel, PerLineParse=True)
split = TextSplit(Text=file, Separators=",")
item = ListItem(List=split, Index=Slider(8, range=0..10), Wrap=True)  # -> flatten(Item)
item_2 = ListItem(List=split, Index=Slider(2, range=0..10), Wrap=True)  # -> flatten(Item)

# ---- group: get the indeces of the sample sites
path_2 = FilePath("C:\Users\carlos\Documents\GitHub\Localcode-grasshopper\SF-grasshopper\sample_files_psd.csv")
file_2 = ReadFile(File=path_2, PerLineParse=True)
split_2 = TextSplit(Text=file_2, Separators="-")
split_3 = TextSplit(Text=split_2, Separators="[")  # -> simplify(Result)
path_mapper = PathMapper(split_3, source="{A;B}", target="{A}")
item_3 = ListItem(List=path_mapper, Index=Slider(1, range=0..1), Wrap=True)
int = Integer(flatten(item_3))
int_2 = Integer(item_2)
mindex = MemberIndex(Set=int_2, Member=flatten(int))  # -> flatten(Index), Count

# ---- group: get the right index
item_4 = ListItem(List=split, Index="0", Wrap=True)  # -> flatten(Item)
item_5 = ListItem(List=mindex.Index, Index=Slider(94, range=0..94), Wrap=True)
item_6 = ListItem(List=item_4, Index=item_5, Wrap=True)

# ----
number_slider = Slider(146, range=1..1374)
panel_2 = Panel("""Linework_InterventionOutlines
TerrainMesh
Linework_SiteCenterline""")
panel_3 = Panel("E:\Local Code\Work\Local Code - San Francisco\06 DB\Pickles\")
int_3 = Integer(item_6)
mindex_2 = MemberIndex(Set=panel_2, Member="TerrainMesh")  # -> Index, Count
mindex_3 = MemberIndex(Set=panel_2, Member="Linework_InterventionOutlines")  # -> Index, Count
unpickle_geometry = UnPickleGeometry(siteNumber=int_3, layer="Data_CNN", path=panel_3, read=panel_3)  # -> out, geometry
# ---------- unpickle_geometry: Python ----------
import cPickle as pickle

if path and read and layer:
    try:
        if siteNumber:
            f = open(path+str(int(siteNumber))+layer)
        else:
            f = open(path+layer)
        geometry = pickle.load(f)
        f.close()

    except:
        print 'problem loading %s\nfile may not exist' % path+str(int(siteNumber))+layer
# ---------- end unpickle_geometry ----------
mindex_4 = MemberIndex(Set=panel_2, Member="Linework_InterventionOutlines")  # -> Index, Count
path_3 = ConstructPath(Indices=mindex_2.Index)
path_4 = ConstructPath(Indices=mindex_3.Index)
unpickle_geometry_2 = UnPickleGeometry(siteNumber=int_3, layer=panel_2, path=panel_3, read=Toggle(True))  # -> out, simplify(geometry); same code as unpickle_geometry
# NEED TO ADD SCALE FACTOR TO FLOWLINES
geo = Geometry(unpickle_geometry_2.geometry)

# ---- group: referenced geometry
geo_2 = Geometry(unpickle_geometry_2.geometry)

# ---- group: ImportedGeometry
geo_3 = Geometry(unpickle_geometry_2.geometry)

# ----
branch = TreeBranch(Tree=geo, Path=path_3, MaintainPaths=True)
branch_2 = TreeBranch(Tree=geo_3, Path=path_4, MaintainPaths=True)
geo_4 = Geometry(branch_2)
geo_5 = Geometry(branch)
project = Project(Geometry=geo_4, Plane=PlaneXY(0, 0, 0))  # -> Geometry, Transform
viewer = ParamViewer(unpickle_geometry_2.geometry)
boundary = BoundarySurfaces(Edges=project.Geometry)
number_slider_2 = Slider(7, range=0..10)
bbox = BoundingBox(Content=geo_5, Plane=PlaneXY(0, 0, 0))  # -> Box, Box_2
panel_4 = Panel(unpickle_geometry_2.geometry)
debrep = DeconstructBrep(Brep=bbox.Box)  # -> Faces, Edges, Vertices
area = Area(Geometry=debrep.Faces)  # -> Area, Centroid
number_slider_3 = Slider(100, range=0..100)
lineyness = Slider(2.4, range=0..10)
pdecon = Deconstruct(Point=area.Centroid)  # -> XComponent, YComponent, ZComponent
sort = SortList(Keys=pdecon.ZComponent, ValuesA=debrep.Faces)  # -> Keys, ValuesA
pt = Point(Point(0, 0, 0))
item_7 = ListItem(List=sort.ValuesA, Index=0, Wrap=True)
evalsrf = EvaluateSurface(Surface=item_7, Point=pt)  # -> Point, Normal, Frame
Y = UnitY(Factor=1)
contour = Contour(Shape=geo_5, Point=evalsrf.Point, Direction=Y, Distance=Slider(5, range=0..10))  # -> simplify(Contours)
cp = ControlPoints(Curve=contour)  # -> Points, Weights, Knots
path_mapper_2 = PathMapper(cp.Points, source="{A;B}", target="{A}")
sort_pt = SortPoints(Points=path_mapper_2)  # -> Points, Indices
pline = PolyLine(Vertices=sort_pt.Points, Closed=False)  # -> flatten(Polyline)
loft_opt = LoftOptions(Closed=False, Adjust=Toggle(False), Rebuild=Slider(13, range=0..100), Refit=0, Type=0)
loft = Loft(Curves=pline, Options=loft_opt)
geo_6 = Geometry(loft)

# ---- group: TerrainNurbs
geo_7 = Geometry(geo_6)

# ----
bbox_2 = BoundingBox(Content=geo_7, Plane=PlaneXY(0, 0, 0))  # -> Box, Box_2
debrep_2 = DeconstructBrep(Brep=bbox_2.Box)  # -> Faces, Edges, Vertices
area_2 = Area(Geometry=debrep_2.Faces)  # -> Area, Centroid
pdecon_2 = Deconstruct(Point=area_2.Centroid)  # -> XComponent, YComponent, ZComponent
sort_2 = SortList(Keys=pdecon_2.ZComponent, ValuesA=debrep_2.Faces)  # -> Keys, ValuesA
item_8 = ListItem(List=sort_2.ValuesA, Index=0, Wrap=True)
dedom2 = DeconstructDomain²(Domain=item_8)  # -> UComponent, VComponent
dedomain = DeconstructDomain(Domain=dedom2.UComponent)  # -> Start, End
dedomain_2 = DeconstructDomain(Domain=dedom2.VComponent)  # -> Start, End
integer_division = IntegerDivision(A=dedomain.End, B=number_slider_2)
integer_division_2 = IntegerDivision(A=dedomain_2.End, B=number_slider_2)
sdivide = DivideSurface(Surface=item_8, UCount=integer_division, VCount=integer_division_2)  # -> Points, Normals, Parameters
area_3 = Area(Geometry=item_8)  # -> Area, Centroid
integer_division_3 = IntegerDivision(A=area_3.Area, B=Slider(250, range=0..1000))
line = LineSDL(Start=sdivide.Points, Direction=Vector(0, 0, 1), Length=Slider(100, range=0..100))
scx = SurfaceLine(Surface=geo_7, Line=line, LimitToFirst=False)  # -> Curves, flatten(Points), UVPoints, Normal
popgeo = PopulateGeometry(Geometry=geo_7, Count=integer_division_3, Seed=1)
terrain_trace = PythonScript(
    startPoint=popgeo,
    terrainSurface=geo_7,
    stepSize=Slider(1, range=0..10),
    maxSteps=Slider(250, range=0..4000),
    tol=Slider(0, range=0..1))  # -> out, a; inputs startPoint: Point3d, terrainSurface: Surface
# ---------- terrain_trace: Python ----------
import Rhino
 
class DrainBoid(object):
    def __init__(self, point3d, surface, stepsize=0.5, maxsteps=None, tolerance=0.001):
        self.start = point3d
        self.pos = self.start
        result, self.u, self.v = surface.ClosestPoint(self.pos)
        self.surface = surface
        self.stepsize = stepsize
        self.points = [self.start]
        self.state = 'on'
        self.tolerance = tolerance
        self.maxsteps = maxsteps
     
    def makeDrainCurve(self):
        i = 0
        while self.state == 'on':
            i += 1
            if self.maxsteps:
                if i >= self.maxsteps:
                    self.state = 'finished'
            self.nextStep()
        return Rhino.Geometry.Curve.CreateControlPointCurve(self.points, 1)
         
    def nextStep(self):
        result, newFrame = self.surface.FrameAt(self.u, self.v)
        # create a vector from newFrame XAxis
        downVect = newFrame.XAxis
        # figure out hw far to rotate it.
        deltaAngle = Rhino.Geometry.Vector3d.VectorAngle( downVect, Rhino.Geometry.Vector3d(0.0, 0.0, -1.0), newFrame )
        # rotate it in the plane
        downVect.Rotate( deltaAngle, newFrame.ZAxis)
        # set the length
        downVect = downVect.Multiply( self.stepsize, downVect )
        spacePoint = Rhino.Geometry.Point3d.Add(self.pos, downVect)
        result, self.u, self.v = self.surface.ClosestPoint(spacePoint)
        out, newPoint, vects = self.surface.Evaluate(self.u, self.v, 0)
        if newPoint.Z >= self.pos.Z: # if higher
            self.state = 'finished'
        elif not self.checkTolerance(newPoint): # if too close
            self.state = 'finished'
        else:
            self.updatePos( newPoint )
     
    def updatePos(self, newPoint):
        self.points.append(newPoint)
        self.pos = newPoint
     
    def checkTolerance(self, other):
        # checks against another point
        # if it is outside of tolerance, returns True
        return self.pos.DistanceTo( other ) > self.tolerance
 
if terrainSurface:
    b = DrainBoid(startPoint, terrainSurface, stepSize, maxSteps, tol)
    a = b.makeDrainCurve()
# ---------- end terrain_trace ----------
geo_8 = Geometry(terrain_trace.a)
geo_9 = Geometry(geo_8)
project_2 = Project(Geometry=geo_9, Plane=PlaneXY(0, 0, 0))  # -> Geometry, Transform
bcx = BrepCurve(Brep=boundary, Curve=project_2.Geometry)  # -> Curves, Points
ccx = CurveCurve(CurveA=project.Geometry, CurveB=project_2.Geometry)  # -> Points, ParamsA, ParamsB
viewer_2 = ParamViewer(bcx.Curves)
item_9 = TreeItem(Tree=bcx.Curves, Path=viewer_2, Index=0, Wrap=True)
null = NullItem(Item=item_9)  # -> NullFlags, InvalidFlags, Description
cull = CullPattern(List=project_2.Geometry, CullPattern=null.NullFlags)
geo_10 = Geometry(cull)

# ---- group: outside drainage lines that don't intersect intervention
geo_11 = Geometry(geo_10)

# ----
pickler = Pickler(data=geo_6, siteNumber=int_3, layer="TerrainNurbs", path=panel_3, write=Toggle(True))  # -> out, geometry; inputs data: list of GeometryBase
# ---------- pickler: Python ----------
import cPickle as pickle

if path and data and write:
    if siteNumber:
        f = open(path+str(int(siteNumber))+layer, 'wb')
    else:
        f = open(path+layer, 'wb')
    pickle.dump(data, f)
    f.close()
    fcheck = open(path+str(int(siteNumber))+layer)
    geometry = pickle.load(fcheck)
    fcheck.close()
# ---------- end pickler ----------
geo_12 = Geometry(pickler.geometry)

toggle = BooleanToggle(True)
pickler_2 = Pickler(data=flatten(geo_11), siteNumber=int_3, layer="Linework_Drainage_Lines_NonSite", path=panel_3, write=toggle)  # -> out, geometry; inputs data: list of GeometryBase; same code as pickler

path_5 = ConstructPath(Indices=mindex_4.Index)
number_slider_4 = Slider(90, range=0..100)
number_slider_5 = Slider(90, range=0..100)
branch_3 = TreeBranch(Tree=geo_2, Path=path_5, MaintainPaths=True)

# ---- group: intervention outline
geo_13 = Geometry(branch_3)

# ---- group: accomodate different classes of site outlines
lng = ListLength(List=branch_2)
equals = Equality(FirstNumber=lng, SecondNumber="1")  # -> Equality, Inequality
dispatch = Dispatch(List=branch_2, DispatchPattern=equals.Equality)  # -> ListA, ListB
project_3 = Project(Geometry=dispatch.ListB, Plane=PlaneXY(0, 0, 0))  # -> Geometry, Transform
runion = RegionUnion(Curves=project_3.Geometry)
geo_14 = Geometry(runion)
project_4 = Project(Curve=geo_14, Brep=geo_7, Direction=" 0,0,1")

# ----
null_2 = NullItem(Item=runion)  # -> NullFlags, InvalidFlags, Description
dispatch_2 = Dispatch(List=project_3.Geometry, DispatchPattern=null_2.NullFlags)  # -> ListA, ListB
len = Length(Curve=dispatch_2.ListA)
sort_3 = SortList(Keys=len, ValuesA=dispatch_2.ListA)  # -> Keys, ValuesA
item_10 = ListItem(List=reverse(sort_3.ValuesA), Index=0, Wrap=True)
project_5 = Project(Curve=item_10, Brep=geo_7, Direction=" 0,0,1")

# ---- group: accomodate different classes of site outlines (continued)
merge = Merge(Data1=dispatch.ListA, Data2=project_4, Data3=project_5)  # -> flatten(Result)

# ----
flatten = FlattenTree(Tree=merge, Path="{0}")
len_2 = Length(Curve=flatten)
ma = MassAddition(Input=len_2)  # -> Result, PartialResults
sort_4 = SortList(Keys=len_2, ValuesA=flatten)  # -> Keys, ValuesA
item_11 = ListItem(List=reverse(sort_4.Keys), Index=0, Wrap=True)
item_12 = ListItem(List=reverse(sort_4.ValuesA), Index=0, Wrap=True)
integer_division_4 = IntegerDivision(A=ma.Result, B=lineyness)
popgeo_2 = PopulateGeometry(Geometry=flatten, Count=integer_division_4, Seed=1)
terrain_trace_up = PythonScript(
    startPoint=popgeo_2,
    terrainSurface=geo_7,
    stepSize=Slider(1, range=0..10),
    maxSteps=Slider(250, range=0..4000),
    tol=Slider(0, range=0..1))  # -> out, a; inputs startPoint: Point3d, terrainSurface: Surface
# ---------- terrain_trace_up: Python ----------
import Rhino
 
class DrainBoid(object):
    def __init__(self, point3d, surface, stepsize=0.5, maxsteps=None, tolerance=0.001):
        self.start = point3d
        self.pos = self.start
        result, self.u, self.v = surface.ClosestPoint(self.pos)
        self.surface = surface
        self.stepsize = stepsize
        self.points = [self.start]
        self.state = 'on'
        self.tolerance = tolerance
        self.maxsteps = maxsteps
     
    def makeDrainCurve(self):
        i = 0
        while self.state == 'on':
            i += 1
            if self.maxsteps:
                if i >= self.maxsteps:
                    self.state = 'finished'
            self.nextStep()
        return Rhino.Geometry.Curve.CreateControlPointCurve(self.points, 1)
         
    def nextStep(self):
        result, newFrame = self.surface.FrameAt(self.u, self.v)
        # create a vector from newFrame XAxis
        upVect = newFrame.XAxis
        # figure out hw far to rotate it.
        deltaAngle = Rhino.Geometry.Vector3d.VectorAngle( upVect, Rhino.Geometry.Vector3d(0.0, 0.0, 1.0), newFrame )
        # rotate it in the plane
        upVect.Rotate( deltaAngle, newFrame.ZAxis)
        # set the length
        upVect = upVect.Multiply( self.stepsize, upVect )
        spacePoint = Rhino.Geometry.Point3d.Add(self.pos, upVect)
        result, self.u, self.v = self.surface.ClosestPoint(spacePoint)
        out, newPoint, vects = self.surface.Evaluate(self.u, self.v, 0)
        if newPoint.Z <= self.pos.Z: # if lower
            self.state = 'finished'
        elif not self.checkTolerance(newPoint): # if too close
            self.state = 'finished'
        else:
            self.updatePos( newPoint )
     
    def updatePos(self, newPoint):
        self.points.append(newPoint)
        self.pos = newPoint
     
    def checkTolerance(self, other):
        # checks against another point
        # if it is outside of tolerance, returns True
        return self.pos.DistanceTo( other ) > self.tolerance
 
if terrainSurface:
    b = DrainBoid(startPoint, terrainSurface, stepSize, maxSteps, tol)
    a = b.makeDrainCurve()
# ---------- end terrain_trace_up ----------
geo_15 = Geometry(terrain_trace_up.a)

# ---- group: drainage lines from outline
geo_16 = Geometry(geo_15)

# ----
pickler_3 = Pickler(data=flatten(geo_16), siteNumber=int_3, layer="Linework_Drainage_Lines_Site", path=panel_3, write=toggle)  # -> out, geometry; inputs data: list of GeometryBase; same code as pickler

cp_2 = ControlPoints(Curve=terrain_trace_up.a)  # -> Points, Weights, Knots

project_6 = Project(Geometry=geo_13, Plane=PlaneXY(0, 0, 0))  # -> Geometry, Transform
bbox_3 = BoundingBox(Content=project_6.Geometry, Plane=PlaneXY(0, 0, 0), UnionBox=True)  # -> Box, Box_2
debrep_3 = DeconstructBrep(Brep=bbox_3.Box)  # -> Faces, Edges, Vertices
area_4 = Area(Geometry=debrep_3.Faces)  # -> Area, Centroid
join = JoinCurves(Curves=debrep_3.Edges, Preserve=False)
len_3 = Length(Curve=join)
division = Division(A=len_3, B=Slider(23, range=0..100))
offset = Offset(Curve=join, Distance=division, Plane=PlaneXY(0, 0, 0), Corners=1)

# ---- group: view curve
crv = Curve(offset)

crv_2 = Curve(crv)

# ----
create_view = CreateView(geometry=crv_2, azimuth_angle=number_slider_5, altitude=number_slider_4)  # -> geometry_2, view_vector, view_target, view_components
pickle_view = PickleView_2(
    geometry=create_view.geometry_2,
    azimuth_angle=number_slider_5,
    altitude=number_slider_4,
    site_number=int_3,
    path=panel_3,
    write=Toggle(True))  # -> geometry_2, view_vector, view_target
set_view = SetView(setView=Toggle(True), geometry=create_view.geometry_2, vector=create_view.view_vector, target=create_view.view_target)  # -> out, a; inputs geometry: GeometryBase, vector: Vector3d, target: Point3d
# ---------- set_view: Python ----------
import os
import time

import Rhino
import cPickle as pickle
import rhinoscriptsyntax as rs
from scriptcontext import doc


if setView:
    vp = doc.Views.ActiveView.ActiveViewport
    vp.SetCameraDirection( vector, True)
    vp.SetCameraTarget(target, True)
    bb = geometry.GetBoundingBox(True)
    vp.ZoomBoundingBox( bb)
    doc.Views.ActiveView.Redraw()
# ---------- end set_view ----------

# ==== cluster CreateView: Create a Rhino view
azimuth_angle = ClusterInput()  # Enter the azimuth rotation angle (degrees).
geometry = ClusterInput()  # Input the site geometry. The geometry should be a curve.
altitude = ClusterInput()  # Enter the Altitude rotation angle in degrees.
cp = ControlPoints(Curve=geometry)  # -> Points, Weights, Knots
Y = UnitY(Factor=1)
eval = Evaluate(F="x*pi/180", x=azimuth_angle)
eval_2 = Evaluate(F="x*pi/180", x=altitude)
pline = PolyLine(Vertices=cp.Points, Closed=False)
rev = Reverse(Vector=Y)
Z = UnitZ(Factor=1)
pcen = PolygonCenter(Polyline=pline)  # -> CenterV, CenterE
vrot = Rotate(Vector=rev, Axis=Z, Angle=eval)
Z_2 = UnitZ(Factor=1)
pl = Plane(Origin=pcen.CenterV, XAxis=vrot, YAxis=Z_2)
multiplication = Multiplication(A=eval_2, B="-1")
rotate = Rotate(Geometry=pl, Angle=multiplication, Plane=pl)  # -> Geometry, Transform
pcomp = PlaneComponents(Plane=rotate.Geometry)  # -> Origin, XAxis, YAxis, ZAxis
geo = Geometry(flatten([geometry, pcomp.XAxis, pcomp.Origin]))
geometry_2 = ClusterOutput(pline)  # Site Geometry.
view_vector = ClusterOutput(pcomp.XAxis)  # View Orientation Vector.
view_target = ClusterOutput(pcomp.Origin)  # View Target Point.
view_components = ClusterOutput(geo)  # View Components ready to be pickled.

# ==== cluster PickleView_2: Pickle a Rhino view
geometry = ClusterInput()  # Input the site geometry. The geometry should be a curve.
azimuth_angle = ClusterInput()  # Enter the azimuth rotation angle (degrees).
altitude = ClusterInput()  # Enter the Altitude rotation angle in degrees.
site_number = ClusterInput()  # Input a site number for the pickled view.
path = ClusterInput()  # Enter a path to save the pickle.
write = ClusterInput()  # Do you want to write the Pickle? Enter a boolean,
pickle_view = PickleView(geometry=geometry, azimuth_angle=azimuth_angle, altitude=altitude)  # -> geometry_2, view_vector, view_target, view_components
layer_name = Panel("view")
python = PythonScript(geom=geometry, vec=pickle_view.view_vector, pt=pickle_view.view_target)  # -> out, a; inputs geom: Polyline, vec: Vector3d, pt: Point3d
# ---------- python: Python ----------
a = [geom,vec,pt]
# ---------- end python ----------
pickler = PythonScript(data=python.a, siteNumber=site_number, layer=layer_name, path=path, write=write)  # -> out, geometry; inputs data: list of GeometryBase
# ---------- pickler: Python ----------
import cPickle as pickle
import Rhino

if path and data and write:
    if siteNumber:
        f = open(path+str(int(siteNumber))+layer, 'wb')
    else:
        f = open(path+layer, 'wb')
    new_data = [data[0],Rhino.Geometry.Point3d(data[1].Location),Rhino.Geometry.Point3d(data[2].Location)]
    pickle.dump(new_data, f)
    f.close()
    fcheck = open(path+str(int(siteNumber))+layer)
    geometry = pickle.load(fcheck)[0]

    fcheck.close()
# ---------- end pickler ----------
geometry_2 = ClusterOutput(pickler.geometry)  # Site Geometry.
view_vector = ClusterOutput(pickle_view.view_vector)  # View Orientation Vector.
view_target = ClusterOutput(pickle_view.view_target)  # View Target Point.

# ==== cluster PickleView
azimuth_angle = ClusterInput()  # Enter the azimuth rotation angle (degrees).
geometry = ClusterInput()  # Input the site geometry. The geometry should be a curve.
altitude = ClusterInput()  # Enter the Altitude rotation angle in degrees.
cp = ControlPoints(Curve=geometry)  # -> Points, Weights, Knots
Y = UnitY(Factor=1)
eval = Evaluate(F="x*pi/180", x=azimuth_angle)
eval_2 = Evaluate(F="x*pi/180", x=altitude)
pline = PolyLine(Vertices=cp.Points, Closed=False)
rev = Reverse(Vector=Y)
Z = UnitZ(Factor=1)
pcen = PolygonCenter(Polyline=pline)  # -> CenterV, CenterE
vrot = Rotate(Vector=rev, Axis=Z, Angle=eval)
Z_2 = UnitZ(Factor=1)
pl = Plane(Origin=pcen.CenterV, XAxis=vrot, YAxis=Z_2)
multiplication = Multiplication(A=eval_2, B="-1")
rotate = Rotate(Geometry=pl, Angle=multiplication, Plane=pl)  # -> Geometry, Transform
pcomp = PlaneComponents(Plane=rotate.Geometry)  # -> Origin, XAxis, YAxis, ZAxis
pt = Point(pcomp.Origin)
geo = Geometry(flatten([pt, pcomp.XAxis, geometry]))
geometry_2 = ClusterOutput(pline)  # Site Geometry.
view_vector = ClusterOutput(pcomp.XAxis)  # View Orientation Vector.
view_target = ClusterOutput(pcomp.Origin)  # View Target Point.
view_components = ClusterOutput(geo)  # View Components ready to be pickled.
