# Grasshopper definition 02C-Wide Flowlines B.gh (Grasshopper 0.9.76)
# plug-ins: Python Interpreter

# ---- group: Find Printed Width in MM from Excel File Generated by Catalogtree
path = FilePath("C:\Users\carlos\Documents\GitHub\Localcode-grasshopper\SF-grasshopper\Filename and Funding Only_result.csv")
panel = Panel(path)
file = ReadFile(File=panel, PerLineParse=True)
split = TextSplit(Text=file, Separators=",")
item = ListItem(List=split, Index=Slider(8, range=0..10), Wrap=True)  # -> flatten(Item)
item_2 = ListItem(List=split, Index=Slider(2, range=0..10), Wrap=True)  # -> flatten(Item)

# ---- group: get the indeces of the sample sites
path_2 = FilePath("C:\Users\carlos\Documents\GitHub\Localcode-grasshopper\SF-grasshopper\sample_files_psd.csv")
file_2 = ReadFile(File=path_2, PerLineParse=True)
split_2 = TextSplit(Text=file_2, Separators="-")
split_3 = TextSplit(Text=split_2, Separators="[")  # -> simplify(Result)
path_mapper = PathMapper(split_3, source="{A;B}", target="{A}")
item_3 = ListItem(List=path_mapper, Index=Slider(1, range=0..1), Wrap=True)
int = Integer(flatten(item_3))
int_2 = Integer(item_2)
mindex = MemberIndex(Set=int_2, Member=flatten(int))  # -> flatten(Index), Count

# ---- group: get the right index
item_4 = ListItem(List=split, Index="0", Wrap=True)  # -> flatten(Item)
item_5 = ListItem(List=mindex.Index, Index=Slider(94, range=0..94), Wrap=True)
item_6 = ListItem(List=item_4, Index=item_5, Wrap=True)

# ----
number_slider = Slider(11, range=1..1374)
panel_2 = Panel("""Linework_InterventionOutlines
Linework_Drainage_Lines_Site""")
panel_3 = Panel("E:\Local Code\Work\Local Code - San Francisco\06 DB\Pickles\")
# NEED TO ADD SCALE TO FLOWLINE WIDTH
num = Number(item_6)
toggle = BooleanToggle(True)
mindex_2 = MemberIndex(Set=panel_2, Member="Linework_Drainage_Lines_Site")  # -> Index, Count
mindex_3 = MemberIndex(Set=panel_2, Member="Linework_InterventionOutlines")  # -> Index, Count
path_3 = ConstructPath(Indices=mindex_2.Index)
unpickle_geometry = UnPickleGeometry(siteNumber=num, layer="Data_CNN", path=panel_3, read=toggle)  # -> out, geometry
# ---------- unpickle_geometry: Python ----------
import cPickle as pickle

if path and read and layer:
    try:
        if siteNumber:
            f = open(path+str(int(siteNumber))+layer)
        else:
            f = open(path+layer)
        geometry = pickle.load(f)
        f.close()

    except:
        print 'problem loading %s\nfile may not exist' % path+str(int(siteNumber))+layer
# ---------- end unpickle_geometry ----------
path_4 = ConstructPath(Indices=mindex_3.Index)
unpickle_geometry_2 = UnPickleGeometry(siteNumber=num, layer=panel_2, path=panel_3, read=toggle)  # -> out, simplify(geometry); same code as unpickle_geometry
geo = Geometry(unpickle_geometry_2.geometry)
geo_2 = Geometry(unpickle_geometry_2.geometry)
branch = TreeBranch(Tree=geo, Path=path_3, MaintainPaths=True)
branch_2 = TreeBranch(Tree=geo_2, Path=path_4, MaintainPaths=True)

# ---- group: flowlines-curves
geo_3 = Geometry(branch)

# ----
panel_4 = Panel(unpickle_geometry_2.geometry)
viewer = ParamViewer(unpickle_geometry_2.geometry)

# ---- group: Find Printed Width in MM from Excel File Generated by Catalogtree
panel_5 = Panel(panel)
file_3 = ReadFile(File=panel_5, PerLineParse=True)
split_4 = TextSplit(Text=file_3, Separators=",")
item_7 = ListItem(List=split_4, Index=Slider(8, range=0..10), Wrap=True)  # -> flatten(Item)
item_8 = ListItem(List=split_4, Index=Slider(2, range=0..10), Wrap=True)  # -> flatten(Item)
mindex_4 = MemberIndex(Set=item_8, Member=unpickle_geometry.geometry)  # -> Index, Count
item_9 = ListItem(List=item_7, Index=mindex_4.Index, Wrap=True)

# ---- group: flowlines-curves
geo_4 = Geometry(geo_3)

# ----
len = Length(Curve=geo_4)
sort = SortList(Keys=len, ValuesA=geo_4)  # -> Keys, ValuesA

# ---- group: sorted flowline curves
geo_5 = Geometry(sort.ValuesA)

# ---- group: intervention outline
geo_6 = Geometry(branch_2)

# ----
wideyness = Slider(1.2, range=0..10)
end = EndPoints(Curve=geo_5)  # -> Start, End
item_10 = ListItem(List=reverse(flatten(sort.Keys)), Index=0, Wrap=True)

# ---- group: line starts
geo_7 = Geometry(end.Start)

# ----
crv_cp = CurveClosestPoint(Point=graft(geo_7), Curve=geo_6)  # -> Point, Parameter, Distance

# ---- group: curves
lng = ListLength(List=flatten(geo_7))
repeat = RepeatData(Data=graft(geo_6), Length=lng)
flip = FlipMatrix(Data=simplify(repeat))
sort_2 = SortList(Keys=crv_cp.Distance, ValuesA=flip)  # -> Keys, ValuesA
item_11 = ListItem(List=sort_2.ValuesA, Index=0, Wrap=True)

# ---- group: Re-scale Width Non-linearly
split_5 = SplitList(List=item_7, Index=Slider(1, range=0..10))  # -> ListA, ListB
bnd = Bounds(Numbers=split_5.ListB)
remap = RemapNumbers(Value=split_5.ListB, Source=bnd, Target=Domain(0, 1))  # -> Mapped, Clipped
graph = GraphMapper(remap.Clipped, x0=0, x1=1, y0=0, y1=1, container_name="Bezier", cpx=[0, 0, 0.4275362194, 1], cpy=[0, 1, 0.8985507488, 1])
dom = ConstructDomain(DomainStart=Slider(10, range=0..10), DomainEnd=Slider(1.1, range=0..10))
bnd_2 = Bounds(Numbers=split_5.ListB)
subtraction = Subtraction(A=mindex_4.Index, B="1")
remap_2 = RemapNumbers(Value=graph, Source=Domain(0, 1), Target=dom)  # -> Mapped, Clipped
item_12 = ListItem(List=remap_2.Mapped, Index=subtraction, Wrap=True)

# ----
remap_3 = RemapNumbers(Value=sort.Keys, Source=item_10, Target=item_12)  # -> simplify(graft(Mapped)), Clipped

# ---- group: parameters
sort_3 = SortList(Keys=crv_cp.Distance, ValuesA=crv_cp.Parameter)  # -> Keys, ValuesA
item_13 = ListItem(List=sort_3.ValuesA, Index=0, Wrap=True)

# ---- group: points
sort_4 = SortList(Keys=crv_cp.Distance, ValuesA=crv_cp.Point)  # -> Keys, ValuesA
item_14 = ListItem(List=sort_4.ValuesA, Index=0, Wrap=True)

# ----
addition = Addition(A=simplify(item_13), B=simplify(remap_3.Mapped))
subtraction_2 = Subtraction(A=graft(item_13), B=simplify(remap_3.Mapped))
graph_2 = GraphMapper(
    remap.Clipped,
    x0=0,
    x1=1,
    y0=0,
    y1=1,
    container_name="Bezier",
    cpx=[0, 0, 0.5319381952, 1],
    cpy=[0, 0.6676520705, 0.7911244631, 1])
dom_2 = ConstructDomain(DomainStart=subtraction_2, DomainEnd=addition)
remap_4 = RemapNumbers(Value=item_9, Source=bnd, Target=Domain(0, 1))  # -> Mapped, Clipped
eval = EvaluateCurve(Curve=simplify(item_11), Parameter=simplify(addition))  # -> Point, Tangent, Angle
eval_2 = EvaluateCurve(Curve=simplify(item_11), Parameter=simplify(subtraction_2))  # -> Point, Tangent, Angle

# ---- group: sorted flowline curves
geo_8 = Geometry(geo_5)

# ----
remap_5 = RemapNumbers(Value=remap_4.Mapped, Source=Domain(0, 1), Target=dom)  # -> Mapped, Clipped
vec2pt = Vector2Pt(PointA=graft(geo_7), PointB=eval.Point, Unitize=False)  # -> Vector, Length
vec2pt_2 = Vector2Pt(PointA=graft(geo_7), PointB=eval_2.Point, Unitize=False)  # -> Vector, Length
cp = ControlPoints(Curve=geo_8)  # -> Points, Weights, Knots
panel_6 = Panel(remap_5.Mapped)
panel_7 = Panel(item_12)

# ---- group: only keep the arrows of the top 15% in size / Find Printed Width in MM from Excel File Generated by Catalogtree
panel_8 = Panel(panel)
file_4 = ReadFile(File=panel_8, PerLineParse=True)
split_6 = TextSplit(Text=file_4, Separators=",")
item_15 = ListItem(List=split_6, Index=Slider(8, range=0..10), Wrap=True)  # -> flatten(Item)
item_16 = ListItem(List=split_6, Index=Slider(2, range=0..10), Wrap=True)  # -> flatten(Item)
mindex_5 = MemberIndex(Set=item_16, Member=unpickle_geometry.geometry)  # -> Index, Count
item_17 = ListItem(List=item_15, Index=mindex_5.Index, Wrap=True)

# ----
lng_2 = ListLength(List=cp.Points)
range = Range(Domain=Domain(0, 1), Steps=lng_2)
multiplication = Multiplication(A=vec2pt.Vector, B=range)  # -> reverse(simplify(Result))
multiplication_2 = Multiplication(A=vec2pt_2.Vector, B=range)  # -> reverse(simplify(Result))
pt = Point(cp.Points)
move = Move(Geometry=simplify(pt), Motion=multiplication)  # -> Geometry, Transform
move_2 = Move(Geometry=simplify(pt), Motion=multiplication_2)  # -> Geometry, Transform

# ---- group: only keep the arrows of the top 15% in size
sort_5 = SortList(Keys=item_15)  # -> Keys, ValuesA
lng_3 = ListLength(List=sort_5.Keys)
multiplication_3 = Multiplication(A=lng_3, B=Slider(0.85, range=0..1))
item_18 = ListItem(List=sort_5.Keys, Index=multiplication_3, Wrap=True)
larger = LargerThan(FirstNumber=item_17, SecondNumber=item_18)  # -> LargerThan, OrEqualTo
filter = StreamFilter(Gate=larger.OrEqualTo)

# ----
subcrv = SubCurve(BaseCurve=simplify(item_11), Domain=simplify(dom_2))
intcrv = Interpolate(Vertices=move_2.Geometry, Degree=3, Periodic=False, KnotStyle=1)  # -> Curve, Length, Domain
intcrv_2 = Interpolate(Vertices=move.Geometry, Degree=3, Periodic=False, KnotStyle=1)  # -> Curve, Length, Domain
merge = Merge(Data1=intcrv_2.Curve, Data2=intcrv.Curve, Data3=subcrv)

# ---- group: extruded traces
join = JoinCurves(Curves=merge, Preserve=False)

# ---- group: drainage lines from outline
geo_9 = Geometry(join)

# ---- group: subtract flow lines from site geometry
project = Project(Geometry=geo_6, Plane=PlaneXY(0, 0, 0))  # -> Geometry, Transform
project_2 = Project(Geometry=geo_9, Plane=PlaneXY(0, 0, 0))  # -> Geometry, Transform
cp_2 = ControlPoints(Curve=project.Geometry)  # -> Points, Weights, Knots
pline = PolyLine(Vertices=cp_2.Points, Closed=True)
rdiff = RegionDifference(CurvesA=flatten(project_2.Geometry), CurvesB=flatten(pline))
filter_2 = StreamFilter(Gate=larger.OrEqualTo, Stream0=rdiff, Stream1=geo_9)

# ----
pickler = Pickler(data=flatten(filter_2), siteNumber=num, layer="Linework_Wide_Drainage_Lines_Site", path=panel_3, write=Toggle(True))  # -> out, geometry; inputs data: list of GeometryBase
# ---------- pickler: Python ----------
import cPickle as pickle

if path and data and write:
    if siteNumber:
        f = open(path+str(int(siteNumber))+layer, 'wb')
    else:
        f = open(path+layer, 'wb')
    pickle.dump(data, f)
    f.close()
    fcheck = open(path+str(int(siteNumber))+layer)
    geometry = pickle.load(fcheck)
    fcheck.close()
# ---------- end pickler ----------
