# Grasshopper definition 03-ground hatching I.gh (Grasshopper 0.9.76)
# plug-ins: Python Interpreter, Kangaroo Components

number_slider = Slider(169, range=126..200)
panel = Panel("E:\Local Code\Work\Local Code - San Francisco\06 DB\Pickles\")
overall_fatness_factor = Slider(4, range=0..10)
little_end = Slider(11, range=0..20)
panel_2 = Panel("""Surface_Gardens
Surface_Grass
Surface_Hardscape
Surface_Orchard
Surface_Trees
Surface_Wetland
Linework_SiteCenterline
Linework_Path_Edges
Linework_InterventionOutlines""")
big_end = Slider(3, range=0..10)
overall_fatness_factor_2 = Slider(4, range=0..25)
# Grass Hatch
little_end_2 = Slider(11, range=0..20)
big_end_2 = Slider(3, range=0..10)
overall_fatness_factor_3 = Slider(3, range=0..25)
neg = Negative(Value=Slider(0.5, range=0..1))
# Tree Hatch
little_end_3 = Slider(11, range=0..20)
big_end_3 = Slider(3, range=0..10)
number_slider_2 = Slider(1371, range=0..10000)
toggle = BooleanToggle(True)

# ---- group: scale factor
num = Number(Slider(2, range=0..5))

# ---- group: scale factor relative to local mm
num_2 = Number(num)

num_3 = Number(num_2)

num_4 = Number(num_2)

num_5 = Number(num_2)

# ---- group: scale factor
num_6 = Number(num_2)

# ----
num_7 = Number(num_2)

# ---- group: scale factor
# Path Hatch
num_8 = Number(num_2)

# ----
panel_3 = Panel(num_6)
size_of_circles = Slider(0.18, range=0..1)
density_of_circles = Slider(2, range=0..10)
# All done but the Pickling
num_9 = Number(num_2)
panel_4 = Panel("C:\Users\Carlos Emilio\Documents\Github\SF-grasshopper\SF_print_Sizes.txt")
division_factor = Slider(1, range=0..1)
file = ReadFile(File=panel_4, PerLineParse=True)
split = TextSplit(Text=file, Separators="\t")
pi = Pi(Factor=Slider(0.25, range=0..1))
Z = UnitZ(Factor=1)
item = ListItem(List=split, Index=Slider(3, range=0..10), Wrap=True)  # -> flatten(Item)
item_2 = ListItem(List=split, Index=Slider(8, range=0..10), Wrap=True)  # -> flatten(Item)
division_factor_2 = Slider(1, range=0..1)
biggest_radius = Slider(0.28, range=0..1)
smallest_radius = Slider(0.1, range=0..1)
number_slider_3 = Slider(3, range=0..10)
number_slider_4 = Slider(0.15, range=0..1)
neg_2 = Negative(Value=number_slider_4)
dom = ConstructDomain(DomainStart=number_slider_4, DomainEnd=neg_2)
bendy_amplitude = Slider(0.04, range=0..1)
pi_2 = Pi(Factor=Slider(0.5, range=0..1))
Z_2 = UnitZ(Factor=1)
panel_5 = Panel("""-1
1""")
smallest_radius_2 = Slider(0.14, range=0..1)
biggest_radius_2 = Slider(0.38, range=0..1)

# ---- group: get the indeces of the sample sites
path = FilePath("C:\Users\carlos\Documents\GitHub\Localcode-grasshopper\SF-grasshopper\sample_files_psd.csv")
file_2 = ReadFile(File=path, PerLineParse=True)
split_2 = TextSplit(Text=file_2, Separators="-")
split_3 = TextSplit(Text=split_2, Separators="[")  # -> simplify(Result)
path_mapper = PathMapper(split_3, source="{A;B}", target="{A}")
item_3 = ListItem(List=path_mapper, Index=Slider(1, range=0..1), Wrap=True)
int = Integer(flatten(item_3))

# ----
panel_6 = Panel(file_2)

# ---- group: Find Printed Width in MM from Excel File Generated by Catalogtree
path_2 = FilePath("C:\Users\carlos\Documents\GitHub\Localcode-grasshopper\SF-grasshopper\Filename and Funding Only_result.csv")
panel_7 = Panel(path_2)
file_3 = ReadFile(File=panel_7, PerLineParse=True)
split_4 = TextSplit(Text=file_3, Separators=",")
item_4 = ListItem(List=split_4, Index=Slider(8, range=0..10), Wrap=True)  # -> flatten(Item)
item_5 = ListItem(List=split_4, Index=Slider(2, range=0..10), Wrap=True)  # -> flatten(Item)

# ---- group: get the indeces of the sample sites (continued)
int_2 = Integer(item_5)
mindex = MemberIndex(Set=int_2, Member=flatten(int))  # -> flatten(Index), Count

# ---- group: get the right index
item_6 = ListItem(List=split_4, Index="0", Wrap=True)  # -> flatten(Item)
item_7 = ListItem(List=mindex.Index, Index=Slider(94, range=0..94), Wrap=True)
# Trees to Scale
# Path Hatch to Scale
item_8 = ListItem(List=item_6, Index=item_7, Wrap=True)

# ----
num_10 = Number(item_8)
unpickle_geometry = UnPickleGeometry(siteNumber=num_10, layer="Data_CNN", path=panel, read=panel)  # -> out, geometry
# ---------- unpickle_geometry: Python ----------
import cPickle as pickle

if path and read and layer:
    try:
        if siteNumber:
            f = open(path+str(int(siteNumber))+layer)
        else:
            f = open(path+layer)
        geometry = pickle.load(f)
        f.close()

    except:
        print 'problem loading %s\nfile may not exist' % path+str(int(siteNumber))+layer
# ---------- end unpickle_geometry ----------
panel_8 = Panel(unpickle_geometry.geometry)
unpickle_geometry_2 = UnPickleGeometry(siteNumber=num_10, layer=panel_2, path=panel, read=Toggle(True))  # -> out, geometry; same code as unpickle_geometry

# ---- group: unpickled surfaces
geo = Geometry(unpickle_geometry_2.geometry)

# ----
panel_9 = Panel(geo)
bang = ExplodeTree(Data=geo)  # -> Branch0, Branch1, Branch2, Branch3, Branch4, Branch5, Branch6, Branch7, Branch8

# ---- group: Path Edges
geo_2 = Geometry(bang.Branch7)

# ---- group: path edges
geo_3 = Geometry(geo_2)

# ----
project = Project(Geometry=geo_3, Plane=PlaneXY(0, 0, 0))  # -> Geometry, Transform
reb = RebuildCurve(Curve=project.Geometry, Count=Slider(728, range=0..1000), Tangents=False)
offset_l = OffsetLoose(Curve=reb, Distance=neg)

# ---- group: site centerline
crv = Curve(bang.Branch6)

# ---- group: gardens
geo_4 = Geometry(bang.Branch0)

# ----
# Garden Hatch
garden_surfaces = Geometry(geo_4)

# ---- group: grass
geo_5 = Geometry(simplify(graft(garden_surfaces)))

geo_6 = Geometry(bang.Branch1)

# ---- group: grass surfaces
geo_7 = Geometry(geo_6)

geo_8 = Geometry(simplify(graft(geo_7)))

# ---- group: Hardscape
geo_9 = Geometry(bang.Branch2)

# ---- group: Hardscape Surfaces
# Hardscape Hatch
geo_10 = Geometry(geo_9)

# ---- group: orchard
geo_11 = Geometry(bang.Branch3)

# ---- group: orchard surfaces
# Orchard Hatch
geo_12 = Geometry(geo_11)

geo_13 = Geometry(simplify(graft(geo_12)))

# ---- group: trees
geo_14 = Geometry(bang.Branch4)

# ---- group: tree lines
geo_15 = Geometry(geo_14)

# ----
geo_16 = Geometry(simplify(graft(geo_15)))

# ---- group: wetland
geo_17 = Geometry(bang.Branch5)

# ----
# Wetland Hatch
geometry = Geometry(geo_17)
edges = BrepEdges(Brep=geometry)  # -> Naked, Interior, NonManifold

# ---- group: intervention outlines
geo_18 = Geometry(bang.Branch8)

# ---- group: offset area
area = Area(Geometry=offset_l)  # -> Area, Centroid

# ---- group: original area
area_2 = Area(Geometry=reb)  # -> Area, Centroid

# ---- group: hardscape surfaces
geo_19 = Geometry(simplify(graft(geo_10)))

# ----
join = JoinCurves(Curves=edges.Naked, Preserve=False)
project_2 = Project(Geometry=join, Plane=PlaneXY(0, 0, 0))  # -> Geometry, Transform
larger = LargerThan(FirstNumber=area_2.Area, SecondNumber=area.Area)  # -> LargerThan, OrEqualTo
area_3 = Area(Geometry=join)  # -> Area, Centroid
ma = MassAddition(Input=area_3.Area)  # -> Result, PartialResults

# ---- group: intervention outline
geo_20 = Geometry(geo_18)

# ----
num_11 = Number(ma.Result)

# ---- group: Find Printed Width in MM from Excel File Generated by Catalogtree (continued)
mindex_2 = MemberIndex(Set=item_5, Member=panel_8)  # -> Index, Count
item_9 = ListItem(List=item_4, Index=mindex_2.Index, Wrap=True)

# ----
division = Division(A=num_11, B=density_of_circles)
num_12 = Number(ma.Result)

project_3 = Project(Geometry=geo_20, Plane=PlaneXY(0, 0, 0))  # -> Geometry, Transform
bbox = BoundingBox(Content=project_3.Geometry, Plane=PlaneXY(0, 0, 0), UnionBox=True)  # -> Box, Box_2
debrep = DeconstructBrep(Brep=bbox.Box)  # -> Faces, Edges, Vertices
area_4 = Area(Geometry=debrep.Faces)  # -> Area, Centroid
join_2 = JoinCurves(Curves=debrep.Edges, Preserve=False)
len = Length(Curve=join_2)
division_2 = Division(A=len, B=Slider(23, range=0..100))
offset = Offset(Curve=join_2, Distance=division_2, Plane=PlaneXY(0, 0, 0), Corners=1)

num_13 = Number(division)

split_5 = SplitList(List=item_4, Index=Slider(1, range=0..10))  # -> ListA, ListB
bnd = Bounds(Numbers=split_5.ListB)
remap = RemapNumbers(Value=split_5.ListB, Source=bnd, Target=Domain(0, 1))  # -> Mapped, Clipped
graph = GraphMapper(
    remap.Clipped,
    x0=0,
    x1=1,
    y0=0,
    y1=1,
    container_name="Bezier",
    cpx=[0, 0.6338028312, 0.2268178165, 1],
    cpy=[0, 0, 0.9785944223, 1])
bnd_2 = Bounds(Numbers=split_5.ListB)
subtraction = Subtraction(A=mindex_2.Index, B="1")
remap_2 = RemapNumbers(Value=graph, Source=Domain(0, 1), Target=bnd_2)  # -> Mapped, Clipped
item_10 = ListItem(List=remap_2.Mapped, Index=subtraction, Wrap=True)

division_3 = Division(A=area_3.Area, B=num_12)
boundary = BoundarySurfaces(Edges=join)

# ---- group: view curve
crv_2 = Curve(offset)

crv_3 = Curve(crv_2)

# ----
dim = Dimensions(Surface=crv_3)  # -> UDimension, VDimension
merge = Merge(Data1=dim.UDimension, Data2=dim.VDimension)
sort = SortList(Keys=merge)  # -> Keys, ValuesA
item_11 = ListItem(List=reverse(sort.Keys), Index=0, Wrap=True)

# ---- group: y dimension
num_14 = Number(item_11)

# ----
panel_10 = Panel(item_10)
panel_11 = Panel(item_9)

# ---- group: size of printed width in MM
num_15 = Number(item_10)

num_16 = Number(num_15)

# ----
multiplication = Multiplication(A=num_16, B=Slider(1.8, range=0..10))
division_4 = Division(A=num_14, B=multiplication)

# ---- group: mm size for this design
num_17 = Number(division_4)

# ----
multiplication_2 = Multiplication(A=num_17, B=Slider(0.8, range=0..1))

# ---- group: local mm
num_18 = Number(multiplication_2)

num_19 = Number(num_18)

num_20 = Number(num_18)

num_21 = Number(num_18)

num_22 = Number(num_18)

# ----
num_23 = Number(num_18)

# ---- group: local mm
num_24 = Number(num_18)

# ---- group: local mm times scale factor
multiplication_3 = Multiplication(A=num_3, B=num_19)

# ----
one_over_x = OneOverX(Value=multiplication_3)
multiplication_4 = Multiplication(A=big_end, B=multiplication_3)
multiplication_5 = Multiplication(A=little_end, B=multiplication_3)
multiplication_6 = Multiplication(A=overall_fatness_factor, B=one_over_x)

# ---- group: local mm times scale factor
multiplication_7 = Multiplication(A=num_4, B=num_20)

# ----
one_over_x_2 = OneOverX(Value=multiplication_7)

# ---- group: local mm times scale factor
multiplication_8 = Multiplication(A=num_5, B=num_21)

# ----
one_over_x_3 = OneOverX(Value=multiplication_8)
multiplication_9 = Multiplication(A=overall_fatness_factor_2, B=one_over_x_3)
multiplication_10 = Multiplication(A=big_end_2, B=multiplication_8)
multiplication_11 = Multiplication(A=little_end_2, B=multiplication_8)

# ---- group: local mm times scale factor
multiplication_12 = Multiplication(A=num_6, B=num_22)

# ----
multiplication_13 = Multiplication(A=big_end_3, B=multiplication_7)
multiplication_14 = Multiplication(A=overall_fatness_factor_3, B=one_over_x_2)
multiplication_15 = Multiplication(A=little_end_3, B=multiplication_7)
one_over_x_4 = OneOverX(Value=multiplication_3)
multiplication_16 = Multiplication(A=num_7, B=num_23)

# ---- group: local mm times scale factor
multiplication_17 = Multiplication(A=num_8, B=num_24)

# ----
multiplication_18 = Multiplication(A=multiplication_12, B=Slider(2, range=0..10))
multiplication_19 = Multiplication(A=multiplication_16, B=Slider(2, range=0..10))

untrim = Untrim(Surface=geo_5)
project_4 = Project(Geometry=untrim, Plane=PlaneXY(0, 0, 0))  # -> Geometry, Transform
evalsrf = EvaluateSurface(Surface=geo_5, Point="0,0")  # -> Point, Normal, Frame
debrep_2 = DeconstructBrep(Brep=project_4.Geometry)  # -> Faces, Edges, Vertices
len_2 = Length(Curve=debrep_2.Edges)
sort_2 = SortList(Keys=len_2, ValuesA=debrep_2.Edges)  # -> Keys, ValuesA
item_12 = ListItem(List=reverse(sort_2.ValuesA), Index=0, Wrap=True)
end = EndPoints(Curve=item_12)  # -> Start, End
vec2pt = Vector2Pt(PointA=end.Start, PointB=end.End, Unitize=Toggle(True))  # -> Vector, Length
contour = Contour(Shape=geo_5, Point=evalsrf.Point, Direction=simplify(vec2pt.Vector), Distance=simplify(multiplication_3))

multiplication_20 = Multiplication(A=size_of_circles, B=multiplication_17)

untrim_2 = Untrim(Surface=geo_8)
project_5 = Project(Geometry=untrim_2, Plane=PlaneXY(0, 0, 0))  # -> Geometry, Transform
evalsrf_2 = EvaluateSurface(Surface=geo_8, Point="0,0")  # -> Point, Normal, Frame
debrep_3 = DeconstructBrep(Brep=project_5.Geometry)  # -> Faces, Edges, Vertices
len_3 = Length(Curve=debrep_3.Edges)
sort_3 = SortList(Keys=len_3, ValuesA=debrep_3.Edges)  # -> Keys, ValuesA
item_13 = ListItem(List=reverse(sort_3.ValuesA), Index=0, Wrap=True)
end_2 = EndPoints(Curve=item_13)  # -> Start, End
vec2pt_2 = Vector2Pt(PointA=end_2.Start, PointB=end_2.End, Unitize=Toggle(True))  # -> Vector, Length
contour_2 = Contour(Shape=geo_8, Point=evalsrf_2.Point, Direction=simplify(vec2pt_2.Vector), Distance=simplify(multiplication_7))

one_over_x_5 = OneOverX(Value=multiplication_19)
num_25 = Number(multiplication_20)

untrim_3 = Untrim(Surface=geo_16)
project_6 = Project(Geometry=untrim_3, Plane=PlaneXY(0, 0, 0))  # -> Geometry, Transform
evalsrf_3 = EvaluateSurface(Surface=geo_16, Point="0,0")  # -> Point, Normal, Frame
debrep_4 = DeconstructBrep(Brep=project_6.Geometry)  # -> Faces, Edges, Vertices
len_4 = Length(Curve=debrep_4.Edges)
sort_4 = SortList(Keys=len_4, ValuesA=debrep_4.Edges)  # -> Keys, ValuesA
item_14 = ListItem(List=reverse(sort_4.ValuesA), Index=0, Wrap=True)
end_3 = EndPoints(Curve=item_14)  # -> Start, End
vec2pt_3 = Vector2Pt(PointA=end_3.Start, PointB=end_3.End, Unitize=Toggle(True))  # -> Vector, Length
contour_3 = Contour(Shape=geo_16, Point=evalsrf_3.Point, Direction=simplify(vec2pt_3.Vector), Distance=simplify(multiplication_19))

untrim_4 = Untrim(Surface=geo_13)
project_7 = Project(Geometry=untrim_4, Plane=PlaneXY(0, 0, 0))  # -> Geometry, Transform
evalsrf_4 = EvaluateSurface(Surface=geo_13, Point="0,0")  # -> Point, Normal, Frame
debrep_5 = DeconstructBrep(Brep=project_7.Geometry)  # -> Faces, Edges, Vertices
len_5 = Length(Curve=debrep_5.Edges)
sort_5 = SortList(Keys=len_5, ValuesA=debrep_5.Edges)  # -> Keys, ValuesA
item_15 = ListItem(List=reverse(sort_5.ValuesA), Index=0, Wrap=True)
end_4 = EndPoints(Curve=item_15)  # -> Start, End
vec2pt_4 = Vector2Pt(PointA=end_4.Start, PointB=end_4.End, Unitize=Toggle(True))  # -> Vector, Length
contour_4 = Contour(Shape=geo_13, Point=evalsrf_4.Point, Direction=simplify(vec2pt_4.Vector), Distance=simplify(multiplication_18))

untrim_5 = Untrim(Surface=geo_19)
project_8 = Project(Geometry=untrim_5, Plane=PlaneXY(0, 0, 0))  # -> Geometry, Transform
evalsrf_5 = EvaluateSurface(Surface=geo_19, Point="0,0")  # -> Point, Normal, Frame
debrep_6 = DeconstructBrep(Brep=project_8.Geometry)  # -> Faces, Edges, Vertices
len_6 = Length(Curve=debrep_6.Edges)
sort_6 = SortList(Keys=len_6, ValuesA=debrep_6.Edges)  # -> Keys, ValuesA
item_16 = ListItem(List=reverse(sort_6.ValuesA), Index=0, Wrap=True)
end_5 = EndPoints(Curve=item_16)  # -> Start, End
vec2pt_5 = Vector2Pt(PointA=end_5.Start, PointB=end_5.End, Unitize=Toggle(True))  # -> Vector, Length
contour_5 = Contour(Shape=geo_19, Point=evalsrf_5.Point, Direction=simplify(vec2pt_5.Vector), Distance=simplify(multiplication_8))

sqr = Square(Value=num_25)
num_26 = Number(num_18)
pi_3 = Pi(Factor=sqr)
multiplication_21 = Multiplication(A=num_9, B=num_26)
num_27 = Number(pi_3)
division_5 = Division(A=num_13, B=num_27)
one_over_x_6 = OneOverX(Value=multiplication_21)
multiplication_22 = Multiplication(A=one_over_x_6, B=Slider(2, range=0..10))
int_3 = Integer(division_5)
round = Round(Number=multiplication_22)  # -> Nearest, Floor, Ceiling
multiplication_23 = Multiplication(A=int_3, B=division_3)
one_over_x_7 = OneOverX(Value=round.Ceiling)
int_4 = Integer(multiplication_23)
division_6 = Division(A=Slider(0.87, range=0..1), B=round.Ceiling)
repeat = RepeatData(Data=division_6, Length=round.Ceiling)
ma_2 = MassAddition(Input=repeat)  # -> Result, PartialResults
popgeo = PopulateGeometry(Geometry=boundary, Count=int_4, Seed=1)

# ---- group: Hardscape hatch centerlines
crv_4 = Curve(contour_2)

# ----
neg_3 = Negative(Value=ma_2.PartialResults)
dispatch = Dispatch(List=neg_3, DispatchPattern=larger.LargerThan)  # -> ListA, ListB
neg_4 = Negative(Value=dispatch.ListB)

# ---- group: corrected curve
merge_2 = Merge(Data1=dispatch.ListA, Data2=neg_4)

# ----
one_over_x_8 = OneOverX(Value=multiplication_18)
cir = Circle(Plane=flatten(popgeo), Radius=num_25)
project_9 = Project(Geometry=contour, Plane=PlaneXY(0, 0, 0))  # -> Geometry, Transform

# ---- group: Hardscape hatch centerlines
crv_5 = Curve(contour_5)

# ---- group: hardscape hatch centerlines
crv_6 = Curve(crv_5)

# ----
elevation_hatch = ElevationHatch(crv=crv_6, A=multiplication_8, B=multiplication_9, B_3=multiplication_10, B_2=multiplication_11)  # -> S, C

# ---- group: hatch edges
geo_21 = Geometry(elevation_hatch.C)

# ---- group: hatch surfaces
geo_22 = Geometry(elevation_hatch.S)

# ---- group: Hardscape Hatch
geo_23 = Geometry(geo_21)

# ----
pickler = Pickler(data=flatten(geo_23), siteNumber=num_10, layer="Linework_Hardscape_Hatch", path=panel, write=toggle)  # -> out, geometry; inputs data: list of GeometryBase
# ---------- pickler: Python ----------
import cPickle as pickle

if path and data and write:
    if siteNumber:
        f = open(path+str(int(siteNumber))+layer, 'wb')
    else:
        f = open(path+layer, 'wb')
    pickle.dump(data, f)
    f.close()
    fcheck = open(path+str(int(siteNumber))+layer)
    geometry = pickle.load(fcheck)
    fcheck.close()
# ---------- end pickler ----------
preview = CustomPreview(Geometry=[geo_21, geo_22], Shader=ColourSwatch(SwatchColor=RGB(255, 255, 255)))
rint = RegionIntersection(CurvesA=cir, CurvesB=join)
offset_l_2 = OffsetLoose(Curve=reb, Distance=merge_2)
crv_7 = Curve(simplify(contour_4))
simplify = SimplifyCurve(Curve=project_9.Geometry)  # -> Curve, Simplified
dupln = RemoveDuplicateLines(Lines=flatten(rint), Tolerance=0.01)

# ---- group: wetland hatch
geo_24 = Geometry(dupln)

# ----
pickler_2 = Pickler(data=flatten(geo_24), siteNumber=num_10, layer="Linework_Garden_Hatch", path=panel)  # -> out, geometry; inputs data: list of GeometryBase; same code as pickler

# ---- group: local scale
num_28 = Number(multiplication_18)

# ----
len_7 = Length(Curve=simplify.Curve)

# ---- group: pathway hatch
geo_25 = Geometry(offset_l_2)

# ---- group: pathway lines
geo_26 = Geometry(geo_25)

# ----
pickler_3 = Pickler(data=flatten(geo_26), siteNumber=num_10, layer="Linework_Pathway_Hatch", path=panel, write=toggle)  # -> out, geometry; inputs data: list of GeometryBase; same code as pickler
division_7 = Division(A=len_7, B=multiplication_3)
crv_8 = Curve(simplify(contour_3))
simplify_2 = SimplifyCurve(Curve=crv_7)  # -> Curve, Simplified
round_2 = Round(Number=division_7)  # -> Nearest, Floor, Ceiling
num_29 = Number(multiplication_19)
divide = DivideCurve(Curve=simplify.Curve, Count=round_2.Ceiling, Kinks=False)  # -> Points, Tangents, Parameters
len_8 = Length(Curve=simplify_2.Curve)

# ---- group: wetland hatch
geo_27 = Geometry(dupln)

# ----
multiplication_24 = Multiplication(A=division_factor, B=num_28)
mindex_3 = MemberIndex(Set=item_2, Member=panel_8)  # -> Index, Count
division_8 = Division(A=len_8, B=multiplication_24)
simplify_3 = SimplifyCurve(Curve=crv_8)  # -> Curve, Simplified
vrot = Rotate(Vector=divide.Tangents, Axis=Z, Angle=pi)
item_17 = ListItem(List=item, Index=mindex_3.Index, Wrap=True)
round_3 = Round(Number=division_8)  # -> Nearest, Floor, simplify(Ceiling)
len_9 = Length(Curve=simplify_3.Curve)
tancurve = TangentCurve(Vertices=divide.Points, Tangents=vrot, Blend=Slider(0.4, range=0..1), Degree=3)  # -> simplify(Curve), Length, Domain
preview_2 = CustomPreview(Geometry=geo_27, Shader=ColourSwatch(SwatchColor=RGB(255, 255, 255)))
lng = ListLength(List=garden_surfaces)
panel_12 = Panel(item_17)
multiplication_25 = Multiplication(A=division_factor_2, B=num_29)
project_10 = Project(Geometry=crv_4, Plane=PlaneXY(0, 0, 0))  # -> Geometry, Transform
smaller = SmallerThan(FirstNumber=lng, SecondNumber="1")  # -> SmallerThan, OrEqualTo
division_9 = Division(A=len_9, B=multiplication_25)
divide_2 = DivideCurve(Curve=reparameterize(simplify_2.Curve), Count=round_3.Ceiling, Kinks=False)  # -> simplify(Points), simplify(Tangents), simplify(Parameters)
simplify_4 = SimplifyTree(Tree=tancurve.Curve, Front=False)
simplify_5 = SimplifyCurve(Curve=project_10.Geometry)  # -> Curve, Simplified
len_10 = Length(Curve=crv_8)
round_4 = Round(Number=division_9)  # -> Nearest, Floor, simplify(Ceiling)
dispatch_2 = Dispatch(List=tancurve.Curve, DispatchPattern=smaller.OrEqualTo)  # -> simplify(ListA), simplify(ListB)
viewer = ParamViewer(simplify_4)
len_11 = Length(Curve=simplify_5.Curve)
multiplication_26 = Multiplication(A=Slider(0.2, range=0..10), B=multiplication_7)

# ---- group: local scale
num_30 = Number(multiplication_18)

# ----
divide_3 = DivideCurve(Curve=reparameterize(simplify_3.Curve), Count=round_4.Ceiling, Kinks=False)  # -> simplify(Points), simplify(Tangents), simplify(Parameters)
division_10 = Division(A=len_11, B=multiplication_26)
item_18 = ListItem(List=flatten(viewer), Index=0, Wrap=True)
len_12 = TextLength(Text=len_10)
multiplication_27 = Multiplication(A=num_30, B=smallest_radius)
multiplication_28 = Multiplication(A=num_30, B=biggest_radius)
pdecon = Deconstruct(Point=divide_2.Points)  # -> XComponent, YComponent, ZComponent
round_5 = Round(Number=division_10)  # -> Nearest, Floor, Ceiling
dpath = DeconstructPath(Branch=item_18)
subtraction_2 = Subtraction(A=len_12, B=number_slider_3)
dom_2 = ConstructDomain(DomainStart=multiplication_27, DomainEnd=multiplication_28)
bnd_3 = Bounds(Numbers=pdecon.ZComponent)
divide_4 = DivideCurve(Curve=simplify_5.Curve, Count=round_5.Ceiling, Kinks=False)  # -> simplify(Points), simplify(Tangents), Parameters
fragment = TextFragment(Text=len_10, Start=subtraction_2, Count=number_slider_3)
lng_2 = ListLength(List=dpath)
equals = Equality(FirstNumber=divide_3.Parameters, SecondNumber=Slider(0, range=0..100))  # -> Equality, Inequality
equals_2 = Equality(FirstNumber=divide_3.Parameters, SecondNumber=Slider(1, range=0..1))  # -> Equality, Inequality
remap_3 = RemapNumbers(Value=pdecon.ZComponent, Source=bnd_3, Target=dom_2)  # -> simplify(Mapped), Clipped
subtraction_3 = Subtraction(A=lng_2, B="1")
project_11 = Project(Curve=flatten(dispatch_2.ListA), Brep=garden_surfaces, Direction=Vector(0, 0, 1))  # -> flatten(Curve)
or = GateOr(A=equals.Equality, B=equals_2.Equality)
trim = TrimTree(Tree=simplify(dispatch_2.ListB), Depth=subtraction_3)
random = Random(Range=dom, Number=expr("x-1", round_4.Ceiling), Seed=fragment)  # -> simplify(Random)
dispatch_3 = Dispatch(List=divide_3.Parameters, DispatchPattern=or)  # -> ListA, ListB
cir_2 = Circle(Plane=divide_2.Points, Radius=remap_3.Mapped)

# ---- group: orchard circles
geo_28 = Geometry(cir_2)

# ----
pickler_4 = Pickler(data=flatten(geo_28), siteNumber=num_10, layer="Linework_Orchard_Hatch", path=panel, write=toggle)  # -> out, geometry; inputs data: list of GeometryBase; same code as pickler
project_12 = Project(Curve=trim, Brep=simplify(graft(garden_surfaces)), Direction=Vector(0, 0, 1))
lng_3 = ListLength(List=divide_4.Points)
vrot_2 = Rotate(Vector=divide_4.Tangents, Axis=Z_2, Angle=pi_2)
boundary_2 = BoundarySurfaces(Edges=cir_2)

# ---- group: ones n zeros
num_31 = Number(dispatch_3.ListA)

# ----
addition = Addition(A=dispatch_3.ListB, B=random)
merge_3 = Merge(Data1=project_12, Data2=project_11)
repeat_2 = RepeatData(Data=panel_5, Length=lng_3)  # -> simplify(Data)
clean = CleanTree(Tree=addition, CleanInvalid=True, CleanEmpty=False)
multiplication_29 = Multiplication(A=multiplication_7, B=bendy_amplitude)

# ---- group: line lengths
num_32 = Number(len_9)

# ----
multiplication_30 = Multiplication(A=multiplication_29, B=repeat_2)
dom_3 = ConstructDomain(DomainStart=0, DomainEnd=num_32)
preview_3 = CustomPreview(Geometry=boundary_2, Shader=ColourSwatch(SwatchColor=RGB(255, 255, 255)))
item_19 = ListItem(List=reverse(num_31), Index=0, Wrap=True)
amp = Amplitude(Vector=vrot_2, Amplitude=multiplication_30)
item_20 = ListItem(List=num_31, Index=0, Wrap=True)

# ---- group: Garden Hatch Lines
crv_9 = Curve(merge_3)

# ----
crv_10 = Curve(simplify(crv_9))
elevation_hatch_2 = ElevationHatch(crv=crv_10, A=multiplication_3, B=multiplication_6, B_3=multiplication_4, B_2=multiplication_5)  # -> S, C

# ---- group: hatch surfaces
geo_29 = Geometry(elevation_hatch_2.S)

# ---- group: hatch edges
geo_30 = Geometry(elevation_hatch_2.C)

# ---- group: garden hatch
geo_31 = Geometry(geo_30)

# ----
pickler_5 = Pickler(data=flatten(geo_31), siteNumber=num_10, layer="Linework_Garden_Hatch", path=panel, write=toggle)  # -> out, geometry; inputs data: list of GeometryBase; same code as pickler
preview_4 = CustomPreview(Geometry=[geo_29, geo_30], Shader=ColourSwatch(SwatchColor=RGB(255, 255, 255)))
move = Move(Geometry=divide_4.Points, Motion=amp)  # -> Geometry, Transform

# ---- group: local factor times mm
num_33 = Number(multiplication_19)

# ----
pline = PolyLine(Vertices=move.Geometry, Closed=False)
multiplication_31 = Multiplication(A=num_33, B=smallest_radius_2)
multiplication_32 = Multiplication(A=num_33, B=biggest_radius_2)
remap_4 = RemapNumbers(Value=multiplication_32, Source=dom_3, Target=Domain(0, 1))  # -> simplify(Mapped), Clipped
subtraction_4 = Subtraction(A=item_19, B=remap_4.Mapped)
addition_2 = Addition(A=item_20, B=remap_4.Mapped)
merge_4 = Merge(Data1=addition_2, Data2=clean, Data3=subtraction_4)
eval = EvaluateCurve(Curve=reparameterize(simplify_3.Curve), Parameter=merge_4)  # -> Point, Tangent, Angle
pdecon_2 = Deconstruct(Point=eval.Point)  # -> XComponent, YComponent, ZComponent
dom_4 = ConstructDomain(DomainStart=multiplication_31, DomainEnd=multiplication_32)
bnd_4 = Bounds(Numbers=pdecon_2.ZComponent)
remap_5 = RemapNumbers(Value=pdecon_2.ZComponent, Source=bnd_4, Target=dom_4)  # -> simplify(Mapped), Clipped
cir_3 = Circle(Plane=eval.Point, Radius=remap_5.Mapped)

# ---- group: tree circles
geo_32 = Geometry(cir_3)

# ----
pickler_6 = Pickler(data=flatten(geo_32), siteNumber=num_10, layer="Linework_Tree_Hatch", path=panel, write=toggle)  # -> out, geometry; inputs data: list of GeometryBase; same code as pickler
lng_4 = ListLength(List=geo_7)
boundary_3 = BoundarySurfaces(Edges=cir_3)
simplify_6 = SimplifyTree(Tree=pline, Front=False)
smaller_2 = SmallerThan(FirstNumber=lng_4, SecondNumber="1")  # -> SmallerThan, OrEqualTo
viewer_2 = ParamViewer(simplify_6)
preview_5 = CustomPreview(Geometry=boundary_3, Shader=ColourSwatch(SwatchColor=RGB(255, 255, 255)))
dispatch_4 = Dispatch(List=pline, DispatchPattern=smaller_2.OrEqualTo)  # -> simplify(ListA), simplify(ListB)
item_21 = ListItem(List=flatten(viewer_2), Index=0, Wrap=True)
dpath_2 = DeconstructPath(Branch=item_21)
flatten = FlattenTree(Tree=geo_7, Path="{0}")
lng_5 = ListLength(List=dpath_2)
subtraction_5 = Subtraction(A=lng_5, B="1")
project_13 = Project(Curve=flatten(dispatch_4.ListA), Brep=geo_7, Direction=Vector(0, 0, 1))  # -> flatten(Curve)
graft = GraftTree(Tree=flatten, IncludeEmptyLists=True, IncludeNullItems=True)  # -> simplify(Tree)
trim_2 = TrimTree(Tree=simplify(dispatch_4.ListB), Depth=subtraction_5)
project_14 = Project(Curve=flatten(trim_2), Brep=graft, Direction=Vector(0, 0, 1))
viewer_3 = ParamViewer(trim_2)
merge_5 = Merge(Data1=project_14, Data2=project_13)
crv_11 = Curve(merge_5)
crv_12 = Curve(crv_11)
elevation_hatch_3 = ElevationHatch(crv=crv_12, A=multiplication_7, B=multiplication_14, B_3=multiplication_13, B_2=multiplication_15)  # -> S, C

# ---- group: solid hatch
geo_33 = Geometry(elevation_hatch_3.S)

# ---- group: hatch edges
geo_34 = Geometry(elevation_hatch_3.C)

# ---- group: grass hatch
geo_35 = Geometry(geo_34)

# ----
pickler_7 = Pickler(data=flatten(geo_35), siteNumber=num_10, layer="Linework_Grass_Hatch", path=panel, write=toggle)  # -> out, geometry; inputs data: list of GeometryBase; same code as pickler
preview_6 = CustomPreview(Geometry=[geo_33, geo_34], Shader=ColourSwatch(SwatchColor=RGB(255, 255, 255)))
panel_13 = Panel(crv_11)

# ==== cluster ElevationHatch
crv = ClusterInput()
A = ClusterInput()
B = ClusterInput()

# ---- group: garden hatch
crv_2 = Curve(simplify(crv))

# ----
division = Division(A=A, B=B)
B_2 = ClusterInput()
B_3 = ClusterInput()

# ---- group: min offset
division_2 = Division(A=division, B=B_2)

# ---- group: max offset
division_3 = Division(A=division, B=B_3)

# ----
len = Length(Curve=crv_2)
dom = ConstructDomain(DomainStart=division_2, DomainEnd=division_3)
division_4 = Division(A=len, B=division)
Z = UnitZ(Factor=1)

# ---- group: offset domain
domain = Domain(dom)

# ----
round = Round(Number=division_4)  # -> Nearest, Floor, Ceiling
pi = Pi(Factor=Slider(0.5, range=0..1))
divide = DivideCurve(Curve=crv_2, Count=round.Ceiling, Kinks=False)  # -> simplify(Points), simplify(Tangents), Parameters
vrot = Rotate(Vector=divide.Tangents, Axis=Z, Angle=pi)
pdecon = Deconstruct(Point=divide.Points)  # -> XComponent, YComponent, ZComponent
unit = UnitVector(Vector=vrot)  # -> graft(Vector)
bnd = Bounds(Numbers=pdecon.ZComponent)
remap = RemapNumbers(Value=pdecon.ZComponent, Source=bnd, Target=domain)  # -> graft(Mapped), Clipped
amp = Amplitude(Vector=unit, Amplitude=remap.Mapped)
Z_2 = UnitZ(Factor=1)
pi_2 = Pi(Factor=1)
vrot_2 = Rotate(Vector=amp, Axis=Z_2, Angle=pi_2)
move = Move(Geometry=graft(divide.Points), Motion=simplify(vrot_2))  # -> Geometry, Transform
move_2 = Move(Geometry=graft(divide.Points), Motion=simplify(amp))  # -> Geometry, Transform
trim = TrimTree(Tree=move_2.Geometry, Depth=1)
trim_2 = TrimTree(Tree=move.Geometry, Depth=1)
intcrv = Interpolate(Vertices=trim_2, Degree=3, Periodic=False, KnotStyle=1)  # -> Curve, Length, Domain
intcrv_2 = Interpolate(Vertices=trim, Degree=3, Periodic=False, KnotStyle=1)  # -> Curve, Length, Domain
rulesrf = RuledSurface(CurveA=intcrv_2.Curve, CurveB=intcrv.Curve)
S = ClusterOutput(rulesrf)
edges = BrepEdges(Brep=rulesrf)  # -> Naked, Interior, NonManifold
join = JoinCurves(Curves=edges.Naked, Preserve=False)
C = ClusterOutput(join)
