# Grasshopper definition 03_Pickle_to_AI.gh (Grasshopper 0.9.76)
# plug-ins: LocalCode, Python Interpreter

# ---- group: Find Printed Width in MM from Excel File Generated by Catalogtree
path = FilePath("C:\Users\carlos\Documents\GitHub\Localcode-grasshopper\SF-grasshopper\Filename and Funding Only_result.csv")
panel = Panel(path)
file = ReadFile(File=panel, PerLineParse=True)
split = TextSplit(Text=file, Separators=",")
item = ListItem(List=split, Index=Slider(8, range=0..10), Wrap=True)  # -> flatten(Item)
item_2 = ListItem(List=split, Index=Slider(2, range=0..10), Wrap=True)  # -> flatten(Item)

# ---- group: get the indeces of the sample sites
path_2 = FilePath("C:\Users\carlos\Documents\GitHub\Localcode-grasshopper\SF-grasshopper\sample_files_psd.csv")
file_2 = ReadFile(File=path_2, PerLineParse=True)
split_2 = TextSplit(Text=file_2, Separators="-")
split_3 = TextSplit(Text=split_2, Separators="[")  # -> simplify(Result)
path_mapper = PathMapper(split_3, source="{A;B}", target="{A}")
item_3 = ListItem(List=path_mapper, Index=Slider(1, range=0..1), Wrap=True)
int = Integer(flatten(item_3))
int_2 = Integer(item_2)
mindex = MemberIndex(Set=int_2, Member=flatten(int))  # -> flatten(Index), Count

# ---- group: get the right index
item_4 = ListItem(List=split, Index="0", Wrap=True)  # -> flatten(Item)
item_5 = ListItem(List=mindex.Index, Index=Slider(2, range=0..94), Wrap=True)
item_6 = ListItem(List=item_4, Index=item_5, Wrap=True)

# ----
panel_2 = Panel(":\Local Code\Work\Local Code - San Francisco\06 DB\Pickles\")
drive = Panel("E")
toggle = BooleanToggle(True)
number_slider = Slider(1, range=1..250)
concat = Concatenate(FragmentA=drive, FragmentB=panel_2)
panel_3 = Panel("""Linework_Buildings
Linework_Cityfeatures
Linework_CityLots
Linework_Drainage_Lines_NonSite
Linework_Drainage_Lines_Site
Linework_Impervious
Linework_InterventionOutlines
Linework_Shadows01_Equinox
Linework_Shadows02_Summer
Linework_Shadows03_Winter
Linework_SurfaceOutlines""")
panel_4 = Panel(concat)
num = Number(item_6)
unpickle_view = UnpickleView(siteNumber=num, path=panel_4, UnPickle=toggle)  # -> out, geometry, vector, target
# ---------- unpickle_view: Python ----------
import os
import time

import Rhino
import cPickle as pickle
import rhinoscriptsyntax as rs
from scriptcontext import doc

if UnPickle:
    f = open(path + '%sview' % int(siteNumber), 'rb')
    view = pickle.load(f)
    f.close()
    if len(view) == 3:
        geometry = view[0]
        vector = Rhino.Geometry.Vector3d(view[1])
        target = view[2]
    else:
        print 'bad view data'
    
    vp = doc.Views.ActiveView.ActiveViewport
    vp.SetCameraDirection( vector, True)
    vp.SetCameraTarget(target, True)
    bb = geometry.GetBoundingBox(True)
    vp.ZoomBoundingBox( bb)
    doc.Views.ActiveView.Redraw()
    #return view
# ---------- end unpickle_view ----------
unpickle_geometry = UnPickleGeometry(siteNumber=num, layer=panel_3, path=panel_4, read=toggle)  # -> out, simplify(geometry)
# ---------- unpickle_geometry: Python ----------
import cPickle as pickle

if path and read and layer:
    try:
        if siteNumber:
            f = open(path+str(int(siteNumber))+layer)
        else:
            f = open(path+layer)
        geometry = pickle.load(f)
        f.close()

    except:
        print 'problem loading %s\nfile may not exist' % path+str(int(siteNumber))+layer
# ---------- end unpickle_geometry ----------
unpickle_geometry_2 = UnPickleGeometry(siteNumber=num, layer="Data_CNN", path=panel_4, read=toggle)  # -> out, geometry; same code as unpickle_geometry
viewer = ParamViewer(unpickle_geometry.geometry)
item_7 = ListItem(List=viewer, Index=Slider(4, range=0..10), Wrap=True)
branch = TreeBranch(Tree=unpickle_geometry.geometry, Path=item_7, MaintainPaths=True)
panel_5 = Panel(":\Local Code\Work\Local Code - San Francisco\06 DB\Step2-AI\")
merge = Merge(
    Data1=ColourSwatch(SwatchColor=RGB(153, 0, 255)),
    Data2=ColourSwatch(SwatchColor=RGB(91, 143, 83)),
    Data3=ColourSwatch(SwatchColor=RGB(0, 255, 170)),
    Data4=ColourSwatch(SwatchColor=RGB(140, 122, 255)),
    Data5=ColourSwatch(SwatchColor=RGB(34, 0, 255)),
    Data6=ColourSwatch(SwatchColor=RGB(0, 255, 102)),
    Data7=ColourSwatch(SwatchColor=RGB(255, 0, 221)),
    Data8=ColourSwatch(SwatchColor=RGB(64, 64, 64)),
    Data9=ColourSwatch(SwatchColor=RGB(112, 112, 112)),
    Data10=ColourSwatch(SwatchColor=RGB(176, 176, 176)),
    Data11=ColourSwatch(SwatchColor=RGB(196, 100, 164)))
concat_2 = Concatenate(FragmentA=drive, FragmentB=panel_5)
concat_3 = Concatenate(FragmentA=concat_2, FragmentB=unpickle_geometry_2.geometry)
concat_4 = Concatenate(FragmentA=concat_3, FragmentB=".ai")
localcodeexport = LocalCodeExport(
    DestinationFilePath=concat_4,
    Export=Toggle(True),
    LayerNames=panel_3,
    LayerColors=merge,
    GeometryTree=unpickle_geometry.geometry)
