# Grasshopper definition 04B-SiteFlowlinesArrows A.gh (Grasshopper 0.9.76)
# plug-ins: Python Interpreter

# ---- group: Find Printed Width in MM from Excel File Generated by Catalogtree
path = FilePath("C:\Users\carlos\Documents\GitHub\Localcode-grasshopper\SF-grasshopper\Filename and Funding Only_result.csv")
panel = Panel(path)
file = ReadFile(File=panel, PerLineParse=True)
split = TextSplit(Text=file, Separators=",")
item = ListItem(List=split, Index=Slider(8, range=0..10), Wrap=True)  # -> flatten(Item)
item_2 = ListItem(List=split, Index=Slider(2, range=0..10), Wrap=True)  # -> flatten(Item)

# ---- group: get the indeces of the sample sites
path_2 = FilePath("C:\Users\carlos\Documents\GitHub\Localcode-grasshopper\SF-grasshopper\sample_files_psd.csv")
file_2 = ReadFile(File=path_2, PerLineParse=True)
split_2 = TextSplit(Text=file_2, Separators="-")
split_3 = TextSplit(Text=split_2, Separators="[")  # -> simplify(Result)
path_mapper = PathMapper(split_3, source="{A;B}", target="{A}")
item_3 = ListItem(List=path_mapper, Index=Slider(1, range=0..1), Wrap=True)
int = Integer(flatten(item_3))
int_2 = Integer(item_2)
mindex = MemberIndex(Set=int_2, Member=flatten(int))  # -> flatten(Index), Count

# ---- group: get the right index
item_4 = ListItem(List=split, Index="0", Wrap=True)  # -> flatten(Item)
item_5 = ListItem(List=mindex.Index, Index=Slider(94, range=0..94), Wrap=True)
item_6 = ListItem(List=item_4, Index=item_5, Wrap=True)

# ----
panel_2 = Panel("""Linework_InterventionOutlines
Linework_Drainage_Lines_Site""")
number_slider = Slider(1374, range=1..1374)
panel_3 = Panel("E:\Local Code\Work\Local Code - San Francisco\06 DB\Pickles\")
num = Number(item_6)
unpickle_geometry = UnPickleGeometry(siteNumber=num, layer="Data_CNN", path=panel_3, read=panel_3)  # -> out, geometry
# ---------- unpickle_geometry: Python ----------
import cPickle as pickle

if path and read and layer:
    try:
        if siteNumber:
            f = open(path+str(int(siteNumber))+layer)
        else:
            f = open(path+layer)
        geometry = pickle.load(f)
        f.close()

    except:
        print 'problem loading %s\nfile may not exist' % path+str(int(siteNumber))+layer
# ---------- end unpickle_geometry ----------
unpickle_geometry_2 = UnPickleGeometry(siteNumber=num, layer=panel_2, path=panel_3, read=Toggle(True))  # -> out, simplify(geometry); same code as unpickle_geometry

# ---- group: lines n geometry
geo = Geometry(unpickle_geometry_2.geometry)

# ----
bang = ExplodeTree(Data=geo)  # -> Branch0, Branch1

# ---- group: lines
geo_2 = Geometry(bang.Branch1)

# ---- group: only keep the arrows of the top 15% in size / Find Printed Width in MM from Excel File Generated by Catalogtree
panel_4 = Panel(panel)
file_3 = ReadFile(File=panel_4, PerLineParse=True)
split_4 = TextSplit(Text=file_3, Separators=",")
item_7 = ListItem(List=split_4, Index=Slider(8, range=0..10), Wrap=True)  # -> flatten(Item)
item_8 = ListItem(List=split_4, Index=Slider(2, range=0..10), Wrap=True)  # -> flatten(Item)
mindex_2 = MemberIndex(Set=item_8, Member=unpickle_geometry.geometry)  # -> Index, Count
item_9 = ListItem(List=item_7, Index=mindex_2.Index, Wrap=True)

# ---- group: intervention outline
geo_3 = Geometry(bang.Branch0)

# ----
size_of_printed_y_dimension_in_mm = Slider(210, range=0..1000)
pi = Pi(Factor=Slider(0.16, range=0..1))
Z = UnitZ(Factor=1)
neg = Negative(Value=pi)

project = Project(Geometry=geo_3, Plane=PlaneXY(0, 0, 0))  # -> Geometry, Transform
bbox = BoundingBox(Content=project.Geometry, Plane=PlaneXY(0, 0, 0), UnionBox=True)  # -> Box, Box_2
debrep = DeconstructBrep(Brep=bbox.Box)  # -> Faces, Edges, Vertices
area = Area(Geometry=debrep.Faces)  # -> Area, Centroid
join = JoinCurves(Curves=debrep.Edges, Preserve=False)
len = Length(Curve=join)
division = Division(A=len, B=Slider(23, range=0..100))
offset = Offset(Curve=join, Distance=division, Plane=PlaneXY(0, 0, 0), Corners=1)

multiplication = Multiplication(A=size_of_printed_y_dimension_in_mm, B=Slider(1.8, range=0..10))
colour = ColourPicker(PickedColour=RGB(255, 255, 255))

# ---- group: view curve
crv = Curve(offset)

crv_2 = Curve(crv)

# ----
dim = Dimensions(Surface=crv_2)  # -> UDimension, VDimension
merge = Merge(Data1=dim.UDimension, Data2=dim.VDimension)
sort = SortList(Keys=merge)  # -> Keys, ValuesA
item_10 = ListItem(List=reverse(sort.Keys), Index=0, Wrap=True)

# ---- group: y dimension
num_2 = Number(item_10)

# ----
division_2 = Division(A=num_2, B=multiplication)

# ---- group: mm size for this design
num_3 = Number(division_2)

# ---- group: local mm
num_4 = Number(num_3)

num_5 = Number(num_4)

# ----
multiplication_2 = Multiplication(A=num_5, B=Slider(11, range=0..100))
multiplication_3 = Multiplication(A=multiplication_2, B=Slider(0.14, range=0..0.2))
merge_2 = Merge(Data1=multiplication_2, Data2=multiplication_3)
dash = DashPattern(Curve=geo_2, Pattern=merge_2)  # -> simplify(Dashes), Gaps
eval = EvaluateCurve(Curve=reparameterize(dash.Dashes), Parameter=Slider(0, range=0..100))  # -> Point, Tangent, Angle
vrot = Rotate(Vector=eval.Tangent, Axis=Z, Angle=pi)
vrot_2 = Rotate(Vector=eval.Tangent, Axis=Z, Angle=neg)
multiplication_4 = Multiplication(A=num_5, B=Slider(1.6, range=0..5))
line = LineSDL(Start=eval.Point, Direction=vrot, Length=multiplication_4)
line_2 = LineSDL(Start=eval.Point, Direction=vrot_2, Length=multiplication_4)
merge_3 = Merge(Data1=dash.Dashes, Data2=line, Data3=line_2)  # -> flatten(Result)

# ---- group: only keep the arrows of the top 15% in size
sort_2 = SortList(Keys=item_7)  # -> Keys, ValuesA
lng = ListLength(List=sort_2.Keys)
multiplication_5 = Multiplication(A=lng, B=Slider(0.85, range=0..1))
item_11 = ListItem(List=sort_2.Keys, Index=multiplication_5, Wrap=True)
larger = LargerThan(FirstNumber=item_9, SecondNumber=item_11)  # -> LargerThan, OrEqualTo
filter = StreamFilter(Gate=larger.OrEqualTo, Stream1=merge_3)

# ----
preview = CustomPreview(Geometry=merge_3, Shader=colour)
pickler = Pickler(data=filter, siteNumber=num, layer="Linework_Site_Flowlines_Arrows", path=panel_3, write=Toggle(True))  # -> out, geometry; inputs data: list of GeometryBase
# ---------- pickler: Python ----------
import cPickle as pickle

if path and data and write:
    if siteNumber:
        f = open(path+str(int(siteNumber))+layer, 'wb')
    else:
        f = open(path+layer, 'wb')
    pickle.dump(data, f)
    f.close()
    fcheck = open(path+str(int(siteNumber))+layer)
    geometry = pickle.load(fcheck)
    fcheck.close()
# ---------- end pickler ----------
