# Grasshopper definition 99_ColorAnalysis.gh (Grasshopper 0.9.76)
# plug-ins: Firefly_X

number_slider = Slider(3, range=1..3)
panel = Panel("D:\Users\demonchaux\Dropbox\¬¬current projects\2013-10-local code book\image color analysis\test images out\sites for color analysis_9030000_0")
txt = Text(number_slider)
int = Integer(number_slider)
concat = Concatenate(FragmentA=panel, FragmentB=int)
concat_2 = Concatenate(FragmentA=concat, FragmentB=".png")
load_bitmap = LoadBitmap(FilePathToImageLocation=concat_2)
number_slider_2 = Slider(100, range=0..100)
panel_2 = Panel(concat)
series = Series(Start=0, Step=1, Count=number_slider_2)
series_2 = Series(Start=0, Step=1, Count=number_slider_2)
crossref = CrossReference(ListA=series, ListB=series_2, CrossMode=1)  # -> ListA, ListB
pt = ConstructPoint(XCoordinate=crossref.ListA, YCoordinate=crossref.ListB, ZCoordinate=0)
sample = BitmapSampler(BitmapToModify=load_bitmap, PointToSample=pt)
pt2num = PointsToNumbers(Points=sample, Mask=4)
split = TextSplit(Text=sample, Separators=",")  # -> simplify(Result)
pt_2 = ConstructPoint(XCoordinate=0, YCoordinate=0, ZCoordinate=0)
flip = FlipMatrix(Data=split)
panel_3 = Panel(flip)
bang = ExplodeTree(Data=flip)  # -> Branch0, Branch1, Branch2
pt_3 = ConstructPoint(XCoordinate=bang.Branch0, YCoordinate=bang.Branch1, ZCoordinate=bang.Branch2)
